# Grasshopper definition dot_print_tests_02_from_algo_10_slicer.ghx (Grasshopper 1.0.8)
# plug-ins: RhinoCodePluginGH

panel = Panel("C:\Users\mangliar\Documents\GitHub\bdm_voxel_builder\temp\2024-08-07_12_20_46_test_config_slice_i4000a1_a1_i4000_pointcloud.json")
filename = Panel("C:\Users\mangliar\Documents\GitHub\bdm_voxel_builder\temp\2024-08-07_12_58_46_test_config_slice_b_i1000a1_a1_i1000_pointcloud.json")
path = FilePath("C:\Users\mangliar\Documents\GitHub\bdm_voxel_builder\docs\algo_10_slicer\")

folder = Panel(path)
reload = Button()
import_and_sort_pts = IronPython2Script(folder=folder, nth=Slider(0, range=0..10), reset=reload)  # -> out, filename; inputs folder: String, nth: Int32, reset: Boolean
# ---------- import_and_sort_pts: IronPython ----------
import os
from compas.colors import Color
from compas.geometry import Pointcloud
import json
from ghpythonlib.treehelpers import list_to_tree

def get_nth_newest_file_in_folder(folder_path, n = 0):
    try:
        # Get a list of files in the folder
        files = [os.path.join(folder_path, filename) for filename in os.listdir(folder_path)]

        # Sort the files by change time (modification time) in descending order
        files.sort(key=lambda x: os.path.getmtime(x), reverse=True)

        # Return the newest file
        if files:
            return files[min(n, len(files))]
        else:
            print("Folder is empty.")
            return None
    except Exception as e:
        print(e)
        return None
if reset:
    pass

# params
Nth = nth
print(folder)
filename = get_nth_newest_file_in_folder(folder, Nth)
print(filename)
# ---------- end import_and_sort_pts ----------

panel_2 = Panel("3,3,2")
reload_2 = Button()
pt = Point("11,12,1")  # disabled

import_and_sort_pts_2 = IronPython2Script(filename=import_and_sort_pts.filename, reset=reload_2)  # -> out, pts, values, json_data; inputs filename: String, reset: Boolean
# ---------- import_and_sort_pts_2: IronPython ----------
import os
import json
from ghpythonlib.treehelpers import list_to_tree
from ghpythonlib.components import SortList

with open(filename, 'r') as f:
    json_data = json.load(f)

pointcloud = json_data['pointcloud']

pts = pointcloud['data']['points']
values = json_data['values']

values, pts = SortList(values, pts)
pts = list_to_tree(pts)
# ---------- end import_and_sort_pts_2 ----------
panel_3 = Panel(import_and_sort_pts_2.values)
panel_4 = Panel(import_and_sort_pts_2.pts)

panel_5 = Panel(import_and_sort_pts.filename)

dam = DataDam(DataA=import_and_sort_pts_2.pts, BufferDelay=10000000, BufferMode=2)
item = ListItem(List=dam, Index=0, Wrap=True)  # -> Item, Item1, Item2
pt_2 = ConstructPoint(XCoordinate=item.Item, YCoordinate=item.Item1, ZCoordinate=item.Item2)  # -> flatten(Point)

number_slider = Slider(35, range=0..100)
pt_3 = Point(pt_2)
scale_nu = ScaleNU(Geometry=pt_3, Plane=PlaneXY(0, 0, 0), ScaleX=number_slider, ScaleY=number_slider, ScaleZ=Slider(18, range=0..100))  # -> Geometry, Transform
move = Move(Geometry=scale_nu.Geometry, Motion="100,100,0")  # -> Geometry, Transform

swatch = ColourSwatch(SwatchColor=RGBA(255, 255, 255, 237))

# ----
# print board
panel_6 = Panel("600")
rectangle = Rectangle(Plane=PlaneXY(0, 0, 0), XSize=panel_6, YSize="800", Radius=0)  # -> Rectangle, Length
boundary = BoundarySurfaces(Edges=rectangle.Rectangle)

work_obj_origin_print_bed_offset = Slider(12, range=-100..100)
layer_count = Slider(3, range=0..10)

# ----
# TEST OBJECTIVES: 01: square dot block print: 3x5x4
# 
# PARAMETER tests
# 
# A: layer height / wait time
# 
# B: dot distance / speed
layer_height = Panel("18")
speed = Panel("40")
dot_distance = Panel("34")
wait_time = Panel("1.2")
merge = Merge(Data1=layer_height, Data2=dot_distance, Data3=speed, Data4=wait_time, Data5=work_obj_origin_print_bed_offset)

pt_4 = Point("400 ,540 ,0")
sqgrid = Square(Plane=pt_4, Size=dot_distance, ExtentX=Slider(3, range=0..10), ExtentY=Slider(5, range=0..10))  # -> Cells, Points
xy = XYPlane(Origin=sqgrid.Points)

num = Number(merge)
num_2 = Number(layer_count)

filename_2 = Panel("dot_print_test_01")
values = Panel(num)
variables = Panel("""layer_height
dot_distance
speed
wait_time""")

variables_2 = Panel("""PUMP
0.5
FEEDER
15""")

send = Button()

# ----
# lift with layerheight/
# adjusted with workobject offset
# note : work obj is calibrated at +12 higher than real pellet plane
addition = Addition(A=layer_height, B=work_obj_origin_print_bed_offset)
Z = UnitZ(Factor=addition)
move_2 = Move(Geometry=xy, Motion=Z)  # -> Geometry, Transform

variables_3 = Panel("""layer_height
dot_distance
speed
wait_time
bed_z_offset""")
cir = Circle(Plane=move_2.Geometry, Radius=Slider(15, range=0..100))

# ---- group: test-7
num_3 = Number([18, 30, 40, 1, 8])
values_2 = Panel(num_3)
panel_7 = Panel("distance + 5")

# ---- group: test-1
num_4 = Number([8, 24, 5, 2])
values_3 = Panel(num_4)

# ----
lng = ListLength(List=flatten(move_2.Geometry))

# ---- group: test-4
num_5 = Number([20, 24, 40, 1, -6])
values_4 = Panel(num_5)

# ---- group: test-8
# perfect for solid block
# unit 30 mm
# wait_time +0.2
# 
# wait time at layers first *2
num_6 = Number([18, 30, 40, 1.2, 8])
values_5 = Panel(num_6)

# ---- group: test-2
num_7 = Number([12, 24, 25, 1])
values_6 = Panel(num_7)

# ---- group: test-5
# start on wet srf
num_8 = Number([18, 24, 40, 1, 4])
values_7 = Panel(num_8)

# ---- group: test-3
num_9 = Number([25, 24, 40, 1])
values_8 = Panel(num_9)

# ---- group: test-6
# perfect for solid block
# unit 24 mm
# first dot double wait_time
# fixed reverse in script
num_10 = Number([18, 24, 40, 1, 8])
values_9 = Panel(num_10)

# ---- group: test-9
# dot distance +4
# bed Z +4
num_11 = Number([18, 34, 40, 1.2, 12])
# print_bed_Z should be 75% of layer H
values_10 = Panel(num_11)

# ----
init_plane_count = Panel("2")
plane_per_layer = Panel(lng)
layer_count_2 = Number(layer_count)
series = Series(Start=0, Step=plane_per_layer, Count=layer_count_2)
addition_2 = Addition(A=init_plane_count, B=series)
panel_8 = Panel(addition_2)

# ----
# dump fab data
panel_9 = Panel(filename_2)
path_2 = FilePath("C:\Users\mangliar\Documents\GitHub\bdm_voxel_builder\data\live\fab_data\")
folder_2 = Panel(path_2)

# ---- group: abb zone info compas rrc
python = GhPythonScript()  # -> out
# ---------- python: Python ----------
import compas_rrc as rrc
print("zone dict keys:\n",  rrc.Zone.__dict__.keys())
print('zone dict values:\n', rrc.Zone.__dict__.values())
# ---------- end python ----------

# ----
panel_10 = Panel(python)

show_partially = Slider(1, range=0..1)
list = ValueList({"show voxel cubes": 0, "show as printed dots": 1, "show rotated voxel cubes": 2}, selected="show voxel cubes")

lng_2 = ListLength(List=panel_3)
multiplication = Multiplication(A=lng_2, B=show_partially)

point_count = Panel(lng_2)

# ---- group: remap color
split = SplitList(List=panel_3, Index=multiplication)  # -> ListA, ListB
num_12 = Number(split.ListA)
bnd = Bounds(Numbers=num_12)
dedomain = DeconstructDomain(Domain=bnd)  # -> Start, End
division = Division(A=dedomain.End, B=Slider(1000, range=0..1000))
dom = ConstructDomain(DomainStart=dedomain.Start, DomainEnd=division)
remap = RemapNumbers(Value=num_12, Source=bnd, Target="100 to 255")  # -> Mapped, Clipped
remap_2 = RemapNumbers(Value=remap.Mapped, Source="0 to 1", Target=Domain(0, 1))  # -> Mapped, Clipped
multiplication_2 = Multiplication(A=remap.Mapped, B=Slider(0.55, range=0..1))
multiplication_3 = Multiplication(A=remap.Mapped)
multiplication_4 = Multiplication(A=remap.Mapped)
rgb = ColourRGB(Alpha=255, Red=multiplication_2, Green=remap.Mapped, Blue=remap.Mapped)

# ----
subtraction = Subtraction(A=lng_2, B=Slider(8, range=0..10))

split_2 = SplitList(List=move.Geometry, Index=multiplication)  # -> ListA, ListB
gate = StreamGate(Stream=split_2.ListA, Gate=list)  # -> Target0, Target1, Target2

xy_2 = XYPlane(Origin=Point(0, 0, 0))
rotate = Rotate(Geometry=xy_2, Angle=degrees("45"), Plane=PlaneXY(0, 0, 0))  # -> Geometry, Transform
number_slider_2 = Slider(0.7, range=0..1)
number_slider_3 = Slider(1, range=0..1)
number_slider_4 = Slider(1, range=0..10)
box = CenterBox(Base=rotate.Geometry, X=number_slider_2, Y=number_slider_2, Z=Slider(0.5, range=0..1))
mbox = MeshBox(Base=box, XCount=number_slider_3, YCount=number_slider_3, ZCount=number_slider_3)
move_3 = Move(Motion=gate.Target2)  # -> Geometry, Transform
transform = Transform(Geometry=mbox, Transform=move_3.Transform)
swatch_2 = ColourSwatch(SwatchColor=RGBA(255, 255, 255, 176))
preview = CustomPreview(Geometry=transform, Material=rgb)

msphereex = MeshSphereEx(Base=PlaneXY(0, 0, 0), Radius=Slider(1, range=0..1), Count=Slider(3, range=0..10))
scale_nu_2 = ScaleNU(Geometry=msphereex, Plane=PlaneXY(0, 0, 0), ScaleX=1, ScaleY=1, ScaleZ=Slider(0.8, range=0..1))  # -> Geometry, Transform
transform_2 = Transform(Geometry=scale_nu_2.Geometry, Transform=gate.Target1)
swatch_3 = ColourSwatch(SwatchColor=RGBA(209, 198, 96, 237))
preview_2 = CustomPreview(Geometry=transform_2, Material=rgb)

number_slider_5 = Slider(0.5, range=0..1)
number_slider_6 = Slider(1, range=0..1)
number_slider_7 = Slider(1, range=0..10)
box_2 = CenterBox(Base=PlaneXY(0, 0, 0), X=number_slider_5, Y=number_slider_5, Z=number_slider_5)
move_4 = Move(Motion=gate.Target0)  # -> Geometry, Transform
mbox_2 = MeshBox(Base=box_2, XCount=number_slider_6, YCount=number_slider_6, ZCount=number_slider_6)
swatch_4 = ColourSwatch(SwatchColor=RGBA(209, 96, 187, 237))
transform_3 = Transform(Geometry=mbox_2, Transform=move_4.Transform)
preview_3 = CustomPreview(Geometry=transform_3, Material=rgb)

# ----
# flip order pattern
pln = Plane(move_2.Geometry)
tstat = TreeStatistics(Tree=pln)  # -> Paths, Length, Count
panel_11 = Panel("""True
False""")
cull = CullPattern(List=tstat.Paths, CullPattern=invert(panel_11))
cull_2 = CullPattern(List=tstat.Paths, CullPattern=panel_11)
branch = TreeBranch(Tree=pln, Path=cull_2, MaintainPaths=True)
branch_2 = TreeBranch(Tree=pln, Path=cull, MaintainPaths=True)
rev = ReverseList(List=branch_2)

merge_2 = Merge(Data1=branch, Data2=rev)

flatten = FlattenTree(Tree=merge_2, Path="{0}")

Z_2 = UnitZ(Factor=layer_height)
arrlinear = LinearArray(Geometry=flatten, Direction=Z_2, Count=layer_count)  # -> Geometry, Transform

# ----
# layers
flip = FlipMatrix(Data=arrlinear.Geometry)

# ----
# flip order pattern
pln_2 = Plane(flip)
tstat_2 = TreeStatistics(Tree=pln_2)  # -> Paths, Length, Count
panel_12 = Panel("""True
False""")
cull_3 = CullPattern(List=tstat_2.Paths, CullPattern=invert(panel_12))
cull_4 = CullPattern(List=tstat_2.Paths, CullPattern=panel_12)
branch_3 = TreeBranch(Tree=pln_2, Path=cull_4, MaintainPaths=True)
branch_4 = TreeBranch(Tree=pln_2, Path=cull_3, MaintainPaths=True)
rev_2 = ReverseList(List=branch_4)

merge_3 = Merge(Data1=branch_3, Data2=rev_2)

flatten_2 = FlattenTree(Tree=merge_3, Path="{0}")

# ----
# check order
number_slider_8 = Slider(100, range=0..100)
split_3 = SplitList(List=flatten_2, Index=number_slider_8)  # -> ListA, ListB
pt_5 = Point(split_3.ListA)
order = PointOrder(Points=pt_5)

# ----
# flip and orient planes
pt_6 = Point(flatten_2)
xy_3 = XYPlane(Origin=pt_6)
pflip = FlipPlane(Plane=xy_3, ReverseX=False, ReverseY=False, SwapAxes=True)
rotate_plane = RotatePlane(Plane=pflip, Angle=degrees(Slider(-135, range=-180..180)))

pln_3 = Plane(rotate_plane)
item_2 = ListItem(List=pln_3, Index=0, Wrap=True)  # -> Item1, Item
merge_4 = Merge(Data1=item_2.Item, Data2=item_2.Item1)

# ----
# approach planes
number_slider_9 = Slider(100, range=0..1000)
Z_3 = UnitZ(Factor=number_slider_9)
move_5 = Move(Geometry=merge_4, Motion=Z_3)  # -> Geometry, Transform
bang = ExplodeTree(Data=graft(move_5.Geometry))  # -> flatten(Branch0), flatten(Branch1)

pl_origin = PlaneOrigin(Base=merge_4, Origin="150,-80,0")

# ----
# travel planes
pdecon = Deconstruct(Point=merge_4)  # -> XComponent, YComponent, ZComponent
sort = SortList(Keys=pdecon.ZComponent)  # -> Keys, ValuesA
item_3 = ListItem(List=reverse(sort.Keys), Index=0, Wrap=True)
xy_4 = XYPlane(Origin=Point(0, 0, 0))

lift_travel_plane = Slider(100, range=0..100)

addition_3 = Addition(A=item_3, B=lift_travel_plane)
pl_offset = PlaneOffset(BasePlane=xy_4, Offset=addition_3)
project = Project(Geometry=pl_origin, Plane=pl_offset)  # -> Geometry, Transform
bang_2 = ExplodeTree(Data=graft(project.Geometry))  # -> Branch0, Branch1

merge_5 = Merge(
    Data1=flatten(bang_2.Branch0),
    Data2=flatten(bang.Branch0),
    Data3=flatten(pln_3),
    Data4=flatten(bang.Branch1),
    Data5=flatten(bang_2.Branch1))
order_2 = PointOrder(Points=merge_5)

pln_4 = Plane(merge_5)

# ----
# wait time
multiply_wait_time = Slider(2, range=0..10)
wait_time_2 = Panel(wait_time)
multiplication_5 = Multiplication(A=wait_time_2, B=multiply_wait_time)
panel_13 = Panel(wait_time_2)
panel_14 = Panel(multiplication_5)
long = LongestList(ListA=panel_13, ListB=pln_4, PaddingMode=2)  # -> ListA, ListB
replace = ReplaceItems(List=long.ListA, Item=panel_14, Indices=flatten(panel_8), Wrap=False)
wait_time_3 = Panel(replace)

panel_15 = Panel(speed)
long_2 = LongestList(ListA=panel_15, ListB=pln_4, PaddingMode=2)  # -> ListA, ListB

# ----
# speed
panel_16 = Panel("10")
panel_17 = Panel("""0
1""")
lng_3 = ListLength(List=long_2.ListA)
lng_4 = ListLength(List=long_2.ListA)
addition_4 = Addition(A=lng_3, B="-1")
addition_5 = Addition(A=lng_4, B="-2")
merge_6 = Merge(Data1=panel_17, Data2=addition_4)
merge_7 = Merge(Data1="2", Data2=addition_5)
replace_2 = ReplaceItems(List=long_2.ListA, Item="100", Indices=merge_6, Wrap=False)
replace_3 = ReplaceItems(List=replace_2, Item=panel_16, Indices=merge_7, Wrap=False)
speed_2 = Panel(replace_3)

# ----
# io 5 print
panel_18 = Panel("1")
long_3 = LongestList(ListA=panel_18, ListB=pln_4, PaddingMode=2)  # -> ListA, ListB
panel_19 = Panel("""0
1""")

lng_5 = ListLength(List=long_3.ListA)
addition_6 = Addition(A=lng_5, B="-1")
replace_4 = ReplaceItems(List=long_3.ListA, Item="0", Indices=[addition_6, panel_19], Wrap=False)

printio = Panel(replace_4)

# ----
# io 6 direction
panel_20 = Panel("0")
long_4 = LongestList(ListA=panel_20, ListB=pln_4, PaddingMode=2)  # -> ListA, ListB

panel_21 = Panel("""-3
-2""")
lng_6 = ListLength(List=long_4.ListA)
addition_7 = Addition(A=lng_6, B=panel_21)
replace_5 = ReplaceItems(List=long_4.ListA, Item="1", Indices=addition_7, Wrap=False)

dir_io = Panel(replace_5)

# ----
# design input
zone = Panel("5")
speed_3 = Panel(replace_3)
dir_io_2 = Panel(replace_5)
tool_name = Panel("t_erratic")
wobj_name = Panel("wobj_bhg")
pln_5 = Plane(merge_5)
move_l = Panel("True")
printio_2 = Panel(replace_4)
wait_time_4 = Panel(replace)

python_2 = GhPythonScript(
    planes=pln_5,
    movel=move_l,
    print_IO=printio_2,
    dir_IO=dir_io_2,
    tool_name=tool_name,
    wobj_name=wobj_name,
    speed=speed_3,
    wait_time=wait_time_4,
    zone=zone,
    dump=send,
    folder=path_2,
    filename=panel_9)  # -> out; inputs planes: list of Plane, movel: Boolean, print_IO: list of Int32, dir_IO: list of Int32, speed: list, wait_time: list, zone: Int32, dump: Boolean
# ---------- python_2: Python ----------
"""
component inputs:
dumps simple print fab data
planes: list = None,
print_IO: int | list = 0,
speed: int | list = 100,
zone: str | int | list = "fine",
movel: bool | list = False,"""

import json
import os

from compas_rhino.conversions import plane_to_compas_frame
from compas.data import json_dump


def wrap_fab_data(
    frames = None,
    print_IO = 0,
    dir_IO = 0,
    speed = 100,
    wait_time = 2,
    zone = "Z50",
    movel = False
):
    data = {}
    data["frames"] = frames
    data["print_IO"] = print_IO
    data["dir_IO"] = dir_IO
    data["speed"] = speed
    data["zone"] = zone
    data["movel"] = movel
    data['wait_time'] = wait_time
    return data


frames = []
for plane in planes:
    frames.append(plane_to_compas_frame(plane))

data = wrap_fab_data(frames, print_IO, dir_IO, speed, wait_time, zone, movel)

filename += '.json'
file = os.path.join(folder, filename)
if dump:
    json_dump(data, file)
    print('fab data saved: ', file)
# ---------- end python_2 ----------
panel_22 = Panel(python_2)
