# Grasshopper definition path_planning.ghx (Grasshopper 1.0.8)
# plug-ins: RhinoCodePluginGH, Telepathy

number_slider = Slider(100, range=0..100)
bang = Button()

clear_all_planned_paths = Button()
python = GhPythonScript(clear_planned_paths=clear_all_planned_paths)  # -> out; inputs clear_planned_paths: Boolean
# ---------- python: Python ----------
from scriptcontext import sticky

doc = ghenv.Component.OnPingDocument()

if clear_planned_paths:
    for key in sticky.keys():
        print(key)
        if key.startswith("ppl_pipeline"):
            print(sticky[key])
            sticky[key] = None
    for guid in sticky["ppl_components"]:
        comp = doc.FindComponent(guid)
        comp.ExpireSolution(True)
# ---------- end python ----------

# ----
# Path planning pipeline
radius_extrusions = Slider(0.0035, range=0..10)
file_path = FilePath("C:\Users\tetov\bdm_voxel_builder\docs\algo_10_slicer\2024-08-07_15_44_13_test_config_slice_b_i1000a1_a1_i1000_pointcloud.json")

save_json_with_trajectories = Button()
out_save_ppl_json = RemoteReceiver()
panel = Panel(out_save_ppl_json)

path = FilePath("C:\Users\tetov\bdm_voxel_builder\docs\algo_10_slicer\2024-08-07_15_44_13_test_config_slice_b_i1000a1_a1_i1000_pointcloud.json")
ghpython_script = GhPythonScript(data_path=path)  # -> out, data_ppl_path
# ---------- ghpython_script: Python ----------
import os

def modify_path(filepath):
    base, ext = os.path.splitext(filepath)

    return base + "_ppl" + ext

data_ppl_path = modify_path(data_path)
# ---------- end ghpython_script ----------
panel_2 = Panel(ghpython_script.data_ppl_path)
panel_3 = Panel(path)

unload = PythonScript(bang=bang, module="compas_fab")
# ---------- unload: Python ----------
import sys

def unload_modules(top_level_module_name):
    """Unloads all modules named starting with the specified string.

    This function eases the development workflow when editing a library that is
    used from Rhino/Grasshopper.

    Args:
        top_level_module_name (:obj:`str`): Name of the top-level module to unload.

    Returns:
        list: List of unloaded module names.
    """
    modules = filter(lambda m: m.startswith(top_level_module_name), sys.modules)

    for module in modules:
        sys.modules.pop(module)

    return modules

unload_modules(module)
# ---------- end unload ----------
import_and_sort_pts = IronPython2Script(filename=file_path)  # -> out, pts, values; inputs filename: String, reset: Boolean
# ---------- import_and_sort_pts: IronPython ----------
from compas.data import json_load
from compas_rhino.conversions import point_to_rhino

data = json_load(filename)

pointcloud = data["pointcloud"]
values = data["values"]


pts = [point_to_rhino(pt) for pt in pointcloud]
values
# ---------- end import_and_sort_pts ----------
split_list = SplitList(List=import_and_sort_pts.pts, Index=Slider(2, range=0..1000))  # -> ListA, ListB
number_slider_2 = Slider(0.001, range=0..0.001)
scale = Scale(Geometry=split_list.ListA, Center=Point(0, 0, 0), Factor=Slider(0.01, range=0..1))  # -> Geometry, Transform
construct_plane = ConstructPlane(Origin=scale.Geometry, XAxis=Vector(1, 0, 0), YAxis=Vector(0, 1, 0))
construct_point = ConstructPoint(XCoordinate=Slider(1, range=0..2.5), YCoordinate=Slider(0, range=0..2.5), ZCoordinate=Slider(0.5, range=0..2.5))
move = Move(Geometry=construct_plane, Motion=construct_point)  # -> Geometry, Transform
button = Button()

end_index = Slider(150, range=0..1000)
list = ValueList({"Plan for all": 0, "Plan for non-placed": 1, "Manual index selection": 2}, selected="Manual index selection")
start_index = Slider(0, range=0..1000)
dom = ConstructDomain(DomainStart=start_index, DomainEnd=expr("x-1", end_index))
dam = DataDam(DataA=dom, BufferDelay=10000000, BufferMode=0)

ghpython_script_2 = GhPythonScript()  # -> out, a
# ---------- ghpython_script_2: Python ----------
from compas_ghpython import unload_modules

unload_modules("compas_ghpython")
# ---------- end ghpython_script_2 ----------
load_robot_model = Button()

# ----
# Tool setup
point = Point(Point(-0.02616510393, 0.2127913545, 0.2257367529))
xz_plane = XZPlane(Origin=point)
flip_plane = FlipPlane(Plane=xz_plane, ReverseX=False, ReverseY=False, SwapAxes=True)
deconstruct_plane = DeconstructPlane(Plane=flip_plane)  # -> Origin, XAxis, YAxis, ZAxis
rotate_3d = Rotate3D(Geometry=flip_plane, Angle=degrees(Slider(30, range=0..100)), Center=flip_plane, Axis=deconstruct_plane.YAxis)  # -> Geometry, Transform

compas_fab_ros_connect = COMPASFABROSConnect(port="9090", connect=Toggle(True))  # -> ros_client, is_connected; inputs port: Int32, connect: Boolean
#   port ip: The ip address ROS. Defaults to 127.0.0.1.
#   port port: The port of ROS. Defaults to 9090.
#   port connect: If True, connects to ROS. If False, disconnects from ROS. Defaults to False.
#   port ros_client: The ROS client.
#   port is_connected: True if connection established.
# ---------- compas_fab_ros_connect: Python ----------
"""
Connect or disconnect to ROS.

COMPAS FAB v1.0.2
"""
import compas
from ghpythonlib.componentbase import executingcomponent as component
from scriptcontext import sticky as st

from compas_fab.backends import RosClient
from compas_fab.ghpython.components import create_id


class ROSConnect(component):
    def RunScript(self, ip, port, connect):
        ros_client = None

        ip = ip or "127.0.0.1"
        port = port or 9090

        key = create_id(self, "ros_client")
        ros_client = st.get(key, None)

        if ros_client:
            st[key].close()
        if connect:
            st[key] = RosClient(ip, port)
            st[key].run(5)

        ros_client = st.get(key, None)
        is_connected = ros_client.is_connected if ros_client else False
        return (ros_client, is_connected)
# ---------- end compas_fab_ros_connect ----------
flip_plane_2 = FlipPlane(Plane=move.Geometry, ReverseX=False, ReverseY=False, SwapAxes=True)
compas_fab_ros_robot = COMPASFABROSRobot(ros_client=compas_fab_ros_connect.ros_client, load=Toggle(True))  # -> robot; inputs load: Boolean
#   port ros_client: The ROS client.
#   port load: If True, loads the robot from ROS. Defaults to False.
# ---------- compas_fab_ros_robot: Python ----------
"""
Load robot directly from ROS.

COMPAS FAB v1.0.2
"""

from compas.scene import SceneObject
from ghpythonlib.componentbase import executingcomponent as component
from scriptcontext import sticky as st

from compas_fab.ghpython.components import create_id


import compas_ghpython.drawing



def draw_mesh(vertices, faces, color=None, vertex_normals=None, texture_coordinates=None):
    """Draw mesh in Grasshopper.

    Parameters
    ----------
    vertices : list of point
        List of vertex locations.
    faces : list of list of int
        List of faces defined as lists of indices into the list of vertices.

    Other Parameters
    ----------------
    color : tuple, list | :class:`System.Drawing.Color`, optional
    vertex_normals : bool, optional
    texture_coordinates

    Returns
    -------
    list[:rhino:`Rhino.Geometry.Mesh`]

    """
    mesh = Mesh()
    for a, b, c in vertices:
        mesh.Vertices.Add(a, b, c)
    for face in faces:
        f = len(face)
        if f < 3:
            continue
        if f == 3:
            mesh.Faces.AddFace(*face)
        elif f == 4:
            mesh.Faces.AddFace(*face)
        else:
            if MeshNgon:
                centroid = centroid_points([vertices[index] for index in face])
                c = mesh.Vertices.Add(*centroid)
                facets = []
                for i, j in pairwise(face + face[:1]):
                    facets.append(mesh.Faces.AddFace(i, j, c))
                ngon = MeshNgon.Create(face, facets)
                mesh.Ngons.AddNgon(ngon)

    if vertex_normals:
        count = len(vertex_normals)
        normals = [Vector3f(normal[0], normal[1], normal[2]) for normal in vertex_normals]
        mesh.Normals.SetNormals(normals)

    if texture_coordinates:
        count = len(texture_coordinates)
        tcs = [Point2f(tc[0], tc[1]) for tc in texture_coordinates]
        mesh.TextureCoordinates.SetTextureCoordinates(tcs)

    #if color:
        #count = len(mesh.Vertices)
        #colors = [rs.coercecolor(color) for i in range(count)]
        #mesh.VertexColors.SetColors(colors)

    return mesh



class ROSRobot(component):
    def RunScript(self, ros_client, load):
        key = create_id(self, "robot")
        compas_ghpython.drawing.draw_mesh = draw_mesh
        if ros_client and ros_client.is_connected and load:
            # Load URDF from ROS
            st[key] = ros_client.load_robot(load_geometry=True, precision=12)
            st[key].scene_object = SceneObject(st[key].model, color=None, vertexcolor=None)

        robot = st.get(key, None)
        if robot:  # client sometimes need to be restarted, without needing to reload geometry
            robot.client = ros_client
        return robot
# ---------- end compas_fab_ros_robot ----------
read_fabricationelements_from_json = GhPythonScript(path=path)  # -> out, fabrication_elements, rcf, frames
# ---------- read_fabricationelements_from_json: Python ----------
from compas.data import json_load


data = json_load(path)


print(data["pointcloud"]["data"])
# ---------- end read_fabricationelements_from_json ----------
panel_4 = Panel(compas_fab_ros_connect.is_connected)
ironpython_2_script = IronPython2Script(x=compas_fab_ros_robot)  # -> out, a
# ---------- ironpython_2_script: IronPython ----------
#from compas_robots.ghpython.scene import Robo
print(type(x.model))
from compas.scene import SceneObject
#x.scene_object = SceneObject(RobotModelObject(x.model))

import compas_bootstrapper

print(compas_bootstrapper.INSTALLED_PACKAGES)
# ---------- end ironpython_2_script ----------
draw = Draw(cg=read_fabricationelements_from_json.frames)  # -> rg
#   port cg: The COMPAS geometry or datastructure to be drawn.
#   port rg: The Rhino geometry object.
# ---------- draw: Python ----------
"""
Draws COMPAS geometry in Grasshopper.
"""

from ghpythonlib.componentbase import executingcomponent as component

from compas.scene import SceneObject


class CompasToRhinoGeometry(component):
    def RunScript(self, cg):
        if not cg:
            return None

        return SceneObject(cg).draw()
# ---------- end draw ----------

# ----
# Filter out placed
lng = ListLength(List=read_fabricationelements_from_json.fabrication_elements)
python_2 = GhPythonScript(fab_data=read_fabricationelements_from_json.fabrication_elements)  # -> out, not_placed_idx; inputs fab_data: list
# ---------- python_2: Python ----------
not_placed_idx = []
for i, elem in enumerate(fab_data):
    if not elem.placed_isotimestamp:
        not_placed_idx.append(i)
# ---------- end python_2 ----------
series = Series(Start=0, Step=1, Count=lng)
subset = SubList(List=series, Domain=dam, Wrap=False)  # -> List, Index
filter = StreamFilter(Gate=list, Stream0=series, Stream1=python_2.not_placed_idx, Stream2=subset.List)
difference = SetDifference(SetA=series, SetB=filter)
cull_i = CullIndex(List=read_fabricationelements_from_json.fabrication_elements, Indices=difference, Wrap=False)
cull_i_2 = CullIndex(List=read_fabricationelements_from_json.fabrication_elements, Indices=filter, Wrap=False)
skipped_elems = RemoteSender(cull_i_2)

file_path_2 = FilePath("C:\Users\tetov\Lund University\MAEF, bioDigital Matter & ABM makerspace - General\hardware\bettan\tool_collision.stl")
ghpython_script_3 = GhPythonScript(stl=file_path_2)  # -> out, mesh
# ---------- ghpython_script_3: Python ----------
import math

from compas.datastructures import Mesh
from compas_rhino.conversions import mesh_to_rhino
from compas.geometry import Rotation, Scale, Vector

mesh = Mesh.from_stl(stl)

#R = Rotation.from_axis_and_angle(Vector.Xaxis(), math.radians(90))
Sc = Scale.from_factors([.001]*3)

mesh = mesh.transformed(Sc)

mesh = mesh_to_rhino(mesh)
# ---------- end ghpython_script_3 ----------
ghpython_script_4 = GhPythonScript(robot=compas_fab_ros_robot)  # -> out, main_planning_group
# ---------- ghpython_script_4: Python ----------
main_planning_group = robot.semantics.main_group_name
# ---------- end ghpython_script_4 ----------
compas_fab_attached_tool = COMPASFABAttachedTool(
    robot=compas_fab_ros_robot,
    visual_mesh=ghpython_script_3.mesh,
    collision_mesh=ghpython_script_3.mesh,
    tcf_plane=rotate_3d.Geometry,
    group=ghpython_script_4.main_planning_group,
    connected_to="tool0")  # -> robot; inputs visual_mesh: Mesh, collision_mesh: Mesh
#   port visual_mesh: A visual mesh for the tool.
#   port collision_mesh: A collision mesh for the tool.
#   port tcf_plane: The frame of the tool in tool0 frame.
#   port group: The planning group to which the tool should be attached.
#   port connected_to: The link to which the tool should be connected to.
# ---------- compas_fab_attached_tool: Python ----------
"""
Attach a tool to the robot.

COMPAS FAB v1.0.2
"""

from compas.geometry import Frame
from compas_rhino.conversions import mesh_to_compas
from compas_rhino.conversions import plane_to_compas_frame
from ghpythonlib.componentbase import executingcomponent as component

from compas_fab.robots import Tool


class AttachToolComponent(component):
    def RunScript(self, robot, visual_mesh, collision_mesh, tcf_plane, group, connected_to):
        if robot and robot.client and robot.client.is_connected and visual_mesh:
            if not collision_mesh:
                collision_mesh = visual_mesh

            c_visual_mesh = mesh_to_compas(visual_mesh)
            c_collision_mesh = mesh_to_compas(collision_mesh)

            if not tcf_plane:
                frame = Frame.worldXY()
            else:
                frame = plane_to_compas_frame(tcf_plane)
            tool = Tool(c_visual_mesh, frame, c_collision_mesh, connected_to=connected_to)

            robot.attach_tool(tool, group)

        return robot
# ---------- end compas_fab_attached_tool ----------

# ----
# Orient frames
X = Slider(0, range=-180..180)
deconstruct_plane_2 = DeconstructPlane(Plane=draw)  # -> Origin, XAxis, YAxis, ZAxis
rotate_3d_2 = Rotate3D(Geometry=draw, Angle=degrees(X), Center=deconstruct_plane_2.Origin, Axis=deconstruct_plane_2.XAxis)  # -> Geometry, Transform
Y = Slider(0, range=-180..180)
deconstruct_plane_3 = DeconstructPlane(Plane=rotate_3d_2.Geometry)  # -> Origin, XAxis, YAxis, ZAxis
rotate_3d_3 = Rotate3D(Geometry=rotate_3d_2.Geometry, Angle=degrees(Y), Center=deconstruct_plane_3.Origin, Axis=deconstruct_plane_3.YAxis)  # -> Geometry, Transform
Z = Slider(0, range=-180..180)
deconstruct_plane_4 = DeconstructPlane(Plane=rotate_3d_3.Geometry)  # -> Origin, XAxis, YAxis, ZAxis
rotate_3d_4 = Rotate3D(Geometry=rotate_3d_3.Geometry, Angle=degrees(Z), Center=deconstruct_plane_4.Origin, Axis=deconstruct_plane_4.YAxis)  # -> Geometry, Transform

# ----
# Path constraints
python_3 = GhPythonScript(robot=compas_fab_attached_tool)  # -> out, joint_constraints
# ---------- python_3: Python ----------
from math import radians
from compas_fab.robots import JointConstraint
joint_constraints = []
#joint_constraints.append(JointConstraint("joint_1", radians(-90),
#                      tolerance_below=radians(90),
#                      tolerance_above=radians(100)))

#joint_constraints.append(JointConstraint("joint_3", radians(0),
#                      tolerance_below=radians(90),
#                      tolerance_above=radians(90)))

joint_constraints.append(JointConstraint("joint_4", radians(0),
                      tolerance_below=radians(180),
                      tolerance_above=radians(180)))
joint_constraints.append(JointConstraint("joint_6",
                                         radians(-90),
                                         tolerance_below=radians(200),
                                         tolerance_above=radians(200)))
# ---------- end python_3 ----------

# ---- group: DEBUG CULL, REMOVE LATER
data = Data([0, 3, 4, 5, 6, 8, 10, 11, 14, 17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])

# ----
# Reset scene
compas_fab_planning_scene = COMPASFABPlanningScene(robot=compas_fab_attached_tool)  # -> scene
#   port scene: A planning scene.
# ---------- compas_fab_planning_scene: Python ----------
"""
Create a planning scene.

COMPAS FAB v1.0.2
"""

from ghpythonlib.componentbase import executingcomponent as component
from scriptcontext import sticky as st

from compas_fab.ghpython.components import create_id
from compas_fab.robots import PlanningScene


class PlanningSceneComponent(component):
    def RunScript(self, robot):
        key = create_id(self, "planning_scene")
        if robot:
            st[key] = PlanningScene(robot)
        return st.get(key, None)
# ---------- end compas_fab_planning_scene ----------
cull_index = CullIndex(List=cull_i, Indices=data, Wrap=True)
reset_scene = GhPythonScript(scene=compas_fab_planning_scene, reset=Button())  # -> out
# ---------- reset_scene: Python ----------
if scene and reset:
    scene.reset()
# ---------- end reset_scene ----------

# ----
# Scene
file_path_3 = FilePath("C:\Users\tetov\Lund University\MAEF, bioDigital Matter & ABM makerspace - General\hardware\bettan\bettan_collision.stl")
ghpython_script_5 = GhPythonScript(stl=file_path_3)  # -> out, mesh; same code as ghpython_script_3
compas_fab_collision_mesh = COMPASFABCollisionMesh(scene=compas_fab_planning_scene, mesh=ghpython_script_5.mesh, identifier="platform", add=Button())  # -> ok; inputs mesh: Mesh, add: Boolean, append: Boolean, remove: Boolean
#   port scene: The planning scene.
#   port mesh: A collision mesh.
#   port identifier: The identifier of the collision mesh.
#   port add: If True, adds the collision mesh to the planning scene.
#   port append: If True, appends the collision mesh to the planning scene.
#   port remove: If True, removes the collision mesh from the planning scene.
#   port ok: True if the operation was successfully performed.
# ---------- compas_fab_collision_mesh: Python ----------
"""
Add or remove a collision mesh from the planning scene.

COMPAS FAB v1.0.2
"""

from compas_rhino.conversions import mesh_to_compas
from ghpythonlib.componentbase import executingcomponent as component

from compas_fab.robots import CollisionMesh


class CollisionMeshComponent(component):
    def RunScript(self, scene, M, name, add, append, remove):
        ok = False
        self.Message = ""

        if (add and append) or (append and remove) or (add and remove):
            self.Message = "Use only one operation at a time\n(add, append or remove)"
            raise Exception(self.Message)

        if scene and M and name:
            mesh = mesh_to_compas(M)
            collision_mesh = CollisionMesh(mesh, name)
            if add:
                scene.add_collision_mesh(collision_mesh)
                self.Message = "Added"
                ok = True
            if append:
                scene.append_collision_mesh(collision_mesh)
                self.Message = "Appended"
                ok = True
            if remove:
                scene.remove_collision_mesh(name)
                self.Message = "Removed"
                ok = True
        return ok
# ---------- end compas_fab_collision_mesh ----------

ghpython_script_6 = GhPythonScript(stl=file_path_3)  # -> out, mesh
# ---------- ghpython_script_6: Python ----------
import math

from compas.datastructures import Mesh
from compas_rhino.conversions import mesh_to_rhino
from compas.geometry import Rotation, Scale, Vector
from compas.colors import Color

mesh = Mesh.from_stl(stl)

#R = Rotation.from_axis_and_angle(Vector.Xaxis(), math.radians(90))
Sc = Scale.from_factors([.001]*3)

mesh = mesh.transformed(Sc)

mesh = mesh_to_rhino(mesh,vertexcolors=[Color.red()]*mesh.number_of_vertices(),color=Color.red())
# ---------- end ghpython_script_6 ----------

# ----
# Preview planes (Z should b down)
order = PointOrder()
cluster = Cluster(plane=flatten(flip_plane_2), amplitude=Slider(0.2, range=0..100), R=Slider(0.04, range=0..10))  # -> geo, color
points = PointList(Size=Slider(4, range=0..100))
preview = CustomPreview(Geometry=cluster.geo, Material=cluster.color)

# ----
# Start configuration
a1 = Slider(0, range=-360..360)
a3 = Slider(0, range=-360..360)
a6 = Slider(93, range=-360..360)
a2 = Slider(0, range=-360..360)
a4 = Slider(0, range=-360..360)
a5 = Slider(30, range=-360..360)
forward_kinematics = PythonScript(robot=compas_fab_attached_tool, a1=a1, a2=a2, a3=a3, a4=a4, a5=a5, a6=a6)  # -> configuration
# ---------- forward_kinematics: Python ----------
import math
from compas_robots import Configuration

if robot:
    joint_positions = [a1, a2, a3, a4, a5, a6]
    joint_positions = [math.radians(a) for a in joint_positions]
    types = robot.get_configurable_joint_types(group)
    configuration = Configuration(joint_positions, types)
    print configuration
# ---------- end forward_kinematics ----------

a1_2 = Slider(0, range=-360..360)
a6_2 = Slider(101, range=-360..360)
a2_2 = Slider(0, range=-360..360)
a4_2 = Slider(0, range=-360..360)
a5_2 = Slider(27, range=-360..360)
a3_2 = Slider(-2, range=-360..360)
forward_kinematics_2 = PythonScript(robot=compas_fab_attached_tool, a1=a1_2, a2=a2_2, a3=a3_2, a4=a4_2, a5=a5_2, a6=a6_2)  # -> configuration; same code as forward_kinematics

# ----
# IK
point_2 = Point(<point referenced from the Rhino model>)
flip_plane_3 = FlipPlane(Plane=point_2, ReverseX=False, ReverseY=False, SwapAxes=True)
deconstruct_plane_5 = DeconstructPlane(Plane=flip_plane_3)  # -> Origin, XAxis, YAxis, ZAxis
rotate_3d_5 = Rotate3D(Geometry=flip_plane_3, Angle=degrees(Slider(68, range=0..360)), Center=flip_plane_3, Axis=deconstruct_plane_5.YAxis)  # -> Geometry, Transform
compas_fab_inverse_kinematics = COMPASFABInverseKinematics(robot=compas_fab_attached_tool, plane=rotate_3d_5.Geometry, start_configuration=forward_kinematics)  # -> configuration
#   port plane: The plane or frame to calculate the inverse kinematic for.
#   port start_configuration: If passed, calculates the inverse such that the joint positions differ the least from the start_configuration. Defaults to the zero configuration.
#   port group: The planning group used for calculation. Defaults to the robot's main planning group.
#   port configuration: The planning group's configuration.
# ---------- compas_fab_inverse_kinematics: Python ----------
"""
Calculate the robot's inverse kinematic for a given plane.

COMPAS FAB v1.0.2
"""

from compas_rhino.conversions import plane_to_compas_frame
from ghpythonlib.componentbase import executingcomponent as component


class InverseKinematics(component):
    def RunScript(self, robot, plane, start_configuration, group):
        configuration = None
        if robot and robot.client and robot.client.is_connected and plane:
            frame = plane_to_compas_frame(plane)
            configuration = robot.inverse_kinematics(frame, start_configuration, group)
        return configuration
# ---------- end compas_fab_inverse_kinematics ----------

# ----
# FK
compas_fab_forward_kinematics = COMPASFABForwardKinematics(robot=compas_fab_attached_tool)  # -> frame; inputs use_only_model: Boolean
#   port config: The configuration to calculate the forward kinematics for.
#   port group: The planning group used for calculation. Defaults to the robot's main planning group.
#   port link: The link name to calculate forward kinematics for. Defaults to the robot's end effector.
#   port use_only_model: If True, use only the robot model instead of the connected backend to calculate FK.
#   port frame: The resulting frame.
# ---------- compas_fab_forward_kinematics: Python ----------
"""
Calculate the robot's forward kinematic for a given configuration.

COMPAS FAB v1.0.2
"""

from ghpythonlib.componentbase import executingcomponent as component


class ForwardKinematics(component):
    def RunScript(self, robot, config, group, link, use_only_model):
        frame = None
        if robot and config:
            options = {}
            if link:
                options["link"] = link
            if use_only_model:
                options["solver"] = "model"
            frame = robot.forward_kinematics(config, group, options=options)
        return frame
# ---------- end compas_fab_forward_kinematics ----------
draw_2 = Draw(cg=compas_fab_forward_kinematics)  # -> rg
#   port cg: The COMPAS geometry or datastructure to be drawn.
#   port rg: The Rhino geometry object.
# ---------- draw_2: Python ----------
"""
Draws COMPAS geometry in Grasshopper.
"""
from ghpythonlib.componentbase import executingcomponent as component

from compas.artists import Artist


class CompasToRhinoGeometry(component):
    def RunScript(self, cg):
        if not cg:
            return None

        return Artist(cg).draw()
# ---------- end draw_2 ----------

number_slider_3 = Slider(1, range=0..1)

# ----
# Calculate IK for extrusion frame
attempts_per_call = Slider(8, range=1..20)
ik_attempts = Slider(8, range=0..3000)
division = Division(A=ik_attempts, B=attempts_per_call)
round = Round(Number=division)  # -> Nearest, Floor, Ceiling
python_4 = PythonScript(
    robot=compas_fab_attached_tool,
    scene=compas_fab_planning_scene,
    group=ghpython_script_4.main_planning_group,
    start_conf=forward_kinematics,
    fab_elems=flip_plane_2,
    elem_radius=radius_extrusions,
    attempt_loops=number_slider_3,
    attempts_per_call=number_slider_3,
    run=Button())  # -> out, goal_configurations, start_configurations, no_IK_idx; inputs fab_elems: list, ik_constraints: list, attempt_loops: Int32, attempts_per_call: Int32, run: Boolean
# ---------- python_4: Python ----------
import math

from scriptcontext import sticky as st

from compas_robots import Configuration
from compas_fab.robots import CollisionMesh
from compas_fab.backends import RosValidationError
from compas_fab.backends.ros.messages import MoveItErrorCodes

from compas_fab.ghpython.components import create_id

from compas_rhino.conversions import plane_to_compas_frame

component_key = create_id(ghenv.Component, "find_ik_list")
if not st.has_key(component_key):
    st[component_key] = {}

sticky_dict = st[component_key]

coll_mesh_id = component_key + "_coll_mesh_id"

if not start_conf:
    raise Exception("Need start configuration")

if len(ik_constraints) == 0 or not ik_constraints[0]:
    ik_constraints = None

if not collision_scale_factor:
    collision_scale_factor = 1.0

# goal_frames = [elem.entry_frame for elem in fabrication_elements]

if robot and robot.client and robot.client.is_connected:
        scene.remove_collision_mesh(coll_mesh_id)

if robot and robot.client and robot.client.is_connected and run:
    sticky_dict["goal_constraints"] = []
    sticky_dict["goal_confs"] = []
    sticky_dict["no_IK_idx"] = []
    sticky_dict["start_confs"] = [start_conf]

    for i, elem in enumerate(fab_elems):
        for _ in range(attempt_loops):
            try:
                goal_conf = robot.inverse_kinematics(plane_to_compas_frame(elem),
                                                     start_configuration=sticky_dict["start_confs"][-1],
                                                     #start_configuration=start_conf,
                                                     group=group,
                                                     use_attached_tool_frame=True,
                                                     options={
                                                         "attempts": attempts_per_call,
                                                         "constraints": ik_constraints,
                                                         "avoid_collisions": True})
            except RosValidationError as e:
                if e.original_exception.error_code == MoveItErrorCodes.NO_IK_SOLUTION:
                    continue
                else:
                    raise
            break
        else:
            goal_conf = None
            sticky_dict["no_IK_idx"].append(i)

        sticky_dict["goal_confs"].append(goal_conf)
        if i < len(fab_elems) - 1:
            sticky_dict["start_confs"].append(goal_conf)


goal_configurations = sticky_dict.get("goal_confs")
start_configurations = sticky_dict.get("start_confs")
no_IK_idx = sticky_dict.get("no_IK_idx")

if not goal_configurations or len(goal_configurations) == 0:
    print("Ready to calculate IK!")
elif len(goal_configurations) == len(fab_elems) == len(start_configurations):
    print("IK done!")
else:
    print("Couldn't find IK for {} frames: {}".format(len(no_IK_idx), no_IK_idx))
# ---------- end python_4 ----------

boolean_toggle = BooleanToggle(True)

# ----
# Joint tolerances for goal constraints
a1_3 = Slider(0, range=0..360)
a3_3 = Slider(0, range=0..360)
a6_3 = Slider(180, range=0..360)
a2_3 = Slider(0, range=0..360)
a4_3 = Slider(0, range=0..360)
a5_3 = Slider(0, range=0..360)
forward_kinematics_3 = PythonScript(a1=a1_3, a2=a2_3, a3=a3_3, a4=a4_3, a5=a5_3, a6=a6_3)  # -> joint_tol
# ---------- forward_kinematics_3: Python ----------
import math

joint_tol_degrees = [a1, a2, a3, a4, a5, a6]
joint_tol = [math.radians(a) for a in joint_tol_degrees]
# ---------- end forward_kinematics_3 ----------

list_length = ListLength(List=python_4.no_IK_idx)
equality = Equality(FirstNumber=list_length, SecondNumber="0")  # -> Equality, Inequality

# ----
# No IK found
list_item = ListItem(Index=python_4.no_IK_idx, Wrap=True)
pln = Plane(list_item)

stream_filter = StreamFilter(Gate=equality.Inequality, Stream0=python_4.goal_configurations)
ghpython_script_7 = GhPythonScript(
    robot=compas_fab_attached_tool,
    group=ghpython_script_4.main_planning_group,
    goal_configurations=stream_filter,
    joint_tol=forward_kinematics_3)  # -> out, goal_constraints; inputs goal_configurations: list, joint_tol: list
# ---------- ghpython_script_7: Python ----------
goal_constraints = [
    robot.constraints_from_configuration(c, 
                                         joint_tol, 
                                         joint_tol, 
                                         group=group)
    for c in goal_configurations
]
# ---------- end ghpython_script_7 ----------

# ---- group: plan motion
# Planning
allowed_planning_time_per_trajectory = Slider(10, range=0..10)
planning_attempts_per_trajectory = Slider(4, range=0..10)
list_2 = ValueList({"RRT", "RRTConnect", "RRT*": "RRTstar", "EST", "PRM": "RPM", "PRM*": "RPMStar", "SPARS"}, selected="RRTConnect")
plan_motion = PythonScript(
    robot=compas_fab_attached_tool,
    scene=compas_fab_planning_scene,
    group=ghpython_script_4.main_planning_group,
    start_configurations=python_4.start_configurations,
    goal_constraints=ghpython_script_7.goal_constraints,
    planner_id=list_2,
    path_constraints=python_3.joint_constraints,
    planning_attempts_per_traj=planning_attempts_per_trajectory,
    allowed_planning_time_per_traj=allowed_planning_time_per_trajectory,
    compute=Button())  # -> out, start_configurations, trajectories, last_confs, succesful, failed_idx; inputs start_configurations: list, goal_constraints: list, path_constraints: list, acm: list
# ---------- plan_motion: Python ----------
from scriptcontext import sticky as st

from compas_fab.robots import PlanningScene
from compas_robots import Configuration
from compas_fab.backends.ros import RosValidationError
from compas_fab.backends.ros.messages import MoveItErrorCodes

guid_obj = ghenv.Component.InstanceGuid
guid = str(guid_obj)
if st.get("ppl_components"):
    st["ppl_components"].add(guid_obj)
else:
    st["ppl_components"] = set([guid_obj])

trajectories_key = "ppl_pipeline_trajectories_" + guid
failed_trajectories_key = "ppl_pipeline_failed_trajectories_" + guid

if len(goal_constraints) == 0 or not goal_constraints[0]:
    raise Exception("Need goal constraints from IK node")

if len(path_constraints) == 0 or not path_constraints[0]:
    path_constraints = None

path_start_conf = start_configurations[0]

if (
   robot
   and robot.client
   and robot.client.is_connected
   and path_start_conf
   and goal_constraints
   and compute
):
    st[trajectories_key] = []
    st[failed_trajectories_key] = {}
    st[failed_trajectories_key]["PLANNING_FAILED"] = []
    st[failed_trajectories_key]["not_whole_path"] = []

    for constraints, start_confs in zip(goal_constraints, start_configurations):
        try:
            trajectory = robot.plan_motion(constraints,
                                           start_configuration=start_confs,
                                           group=group,
                                           options={ "planner_id": planner_id,
                                                     "num_planning_attempts": planning_attempts_per_traj,
                                                     "allowed_planning_time": allowed_planning_time_per_traj,
                                                     "path_constraints": path_constraints,
                                                     "attached_collision_meshes": list(acm)})
        except RosValidationError as e:
                if e.original_exception.error_code == MoveItErrorCodes.PLANNING_FAILED:
                    st[failed_trajectories_key]["PLANNING_FAILED"].append(i)
                else:
                    raise

        if trajectory.fraction < 1.0:
            st[failed_trajectories_key]["not_whole_path"].append(i)

        st[trajectories_key].append(trajectory)
        path_start_conf = trajectory.points[-1]

succesful = None
if st.get(failed_trajectories_key):
    failed = False
    for value in st[failed_trajectories_key].values():
        if len(value) > 0:
            succesful = False
            break
    if succesful is False:

        n_planning_failed = len(st[failed_trajectories_key]["PLANNING_FAILED"])
        n_failed_trajs = len(st[failed_trajectories_key]["not_whole_path"])
        print("{} PLANNING_FAILED and {} trajectories with fraction less than one. Failed trajectories: {}".format(n_planning_failed, n_failed_trajs, st[failed_trajectories_key]))
    else:
        succesful = True
else:
    succesful = True

if st.get(failed_trajectories_key):
    failed_idx = list(set(st[failed_trajectories_key]["PLANNING_FAILED"] + st[failed_trajectories_key]["not_whole_path"]))
trajectories = st.get(trajectories_key)

if succesful:
    if trajectories:
        last_confs = [Configuration.from_revolute_values(traj.points[-1].values()) for traj in trajectories]
        print("Planning done!")
    else:
        print("Ready to plan!")
# ---------- end plan_motion ----------
item = ListItem(List=plan_motion.trajectories, Index=Slider(0, range=0..140), Wrap=True)
vis = PythonScript(trajectory=item)  # -> P, V, A, time
# ---------- vis: Python ----------
from compas_ghpython.sets  import list_to_ghtree

if trajectory:

    positions = []
    velocities = []
    accelerations = []
    time_from_start = []

    for p in trajectory.points:
        positions.append(p.positions)
        velocities.append(p.velocities)
        accelerations.append(p.accelerations)
        time_from_start.append(p.time_from_start.seconds)

    P = list_to_ghtree(list(zip(*positions)))
    V = list_to_ghtree(list(zip(*velocities)))
    A = list_to_ghtree(list(zip(*accelerations)))

    time = time_from_start[-1]
    print time
# ---------- end vis ----------
vis_2 = PythonScript(trajectories=plan_motion.trajectories)  # -> cycle_times; inputs trajectories: list
# ---------- vis_2: Python ----------
from compas_ghpython import list_to_ghtree

cycle_times = []
for trajectory in trajectories:
    time = trajectory.points[-1].time_from_start.seconds
    cycle_times.append(time)
    print(time)
# ---------- end vis_2 ----------
prismatic = QuickGraph(vis.P, SortOrder=0)
panel_5 = Panel("positions")
sort = SortList(Keys=vis_2, ValuesA=plan_motion.trajectories)  # -> reverse(Keys), reverse(ValuesA)
time_s = Panel(vis.time)
graph = QuickGraph(vis.V, SortOrder=0)
graph_2 = QuickGraph(vis.A, SortOrder=0)
panel_6 = Panel("velocities")
panel_7 = Panel("accelerations")

# ----
compas_fab_trajectory_visualize = COMPASFABTrajectoryVisualize()  # -> start_configuration, configurations, fraction, time, planes, P, V, A
#   port group: The planning group for which this trajectory was planned.
#   port trajectory: The calculated trajectory.
#   port start_configuration: The start configuration of the trajectory.
#   port configurations: The full configurations along the trajectory.
#   port fraction: Indicates the fraction of requested trajectory that was calculated, e.g. 1 means the full trajectory was found.
#   port time: The time which is needed to execute that trajectory at full speed.
#   port planes: The planes of the robot's end-effector.
#   port P: The positions along the trajectory
#   port V: The velocities along the trajectory
#   port A: The accelerations along the trajectory
# ---------- compas_fab_trajectory_visualize: Python ----------
"""
Visualizes a trajectory.

COMPAS FAB v1.0.2
"""

from compas_ghpython import draw_frame
from compas_ghpython.sets import list_to_ghtree
from ghpythonlib.componentbase import executingcomponent as component


class TrajectoryVisualize(component):
    def RunScript(self, robot, group, trajectory):
        start_configuration = None
        configurations = []
        fraction = 0.0
        time = 0.0

        planes = []
        positions = []
        velocities = []
        accelerations = []

        if robot and trajectory:
            group = group or robot.main_group_name

            for c in trajectory.points:
                configurations.append(
                    robot.merge_group_with_full_configuration(c, trajectory.start_configuration, group)
                )
                frame = robot.forward_kinematics(c, group, options=dict(solver="model"))
                planes.append(draw_frame(frame))
                positions.append(c.positions)
                velocities.append(c.velocities)
                accelerations.append(c.accelerations)

            start_configuration = trajectory.start_configuration
            fraction = trajectory.fraction
            time = trajectory.time_from_start

        P = list_to_ghtree(list(zip(*positions)))
        V = list_to_ghtree(list(zip(*velocities)))
        A = list_to_ghtree(list(zip(*accelerations)))

        # return outputs if you have them; here I try it for you:
        return (start_configuration, configurations, fraction, time, planes, P, V, A)
# ---------- end compas_fab_trajectory_visualize ----------
boolean_toggle_2 = BooleanToggle(True)
panel_8 = Panel(plan_motion.succesful)
compas_fab_trajectory_visualize_2 = COMPASFABTrajectoryVisualize(robot=compas_fab_attached_tool, group=ghpython_script_4.main_planning_group, trajectory=plan_motion.trajectories)  # -> start_configuration, configurations, fraction, time, planes, P, V, A; same code as compas_fab_trajectory_visualize
clean_tree = CleanTree(RemoveNulls=Toggle(True), RemoveInvalid=True, RemoveEmpty=False, Tree=python_4.goal_configurations)
file_path_4 = FilePath("C:\Users\tetov\bdm_voxel_builder\temp\confs.json")
from_json = FromJSON(json=file_path_4)  # -> result
#   port json: JSON file path or JSON string.
#   port result: Deserialized objects.
# ---------- from_json: Python ----------
"""
Deserializes JSON into COMPAS objects.
"""

from ghpythonlib.componentbase import executingcomponent as component

import compas


class CompasInfo(component):
    def RunScript(self, json):
        if not json:
            return None

        try:
            return compas.json_load(json)
        except:  # noqa: E722
            return compas.json_loads(json)
# ---------- end from_json ----------

# ----
# Visualization
list_3 = ValueList({"0 forward_kinematics": 0, "1 inverse_kinematics": 1, "2 IK_list": 2, "3 ppl": 3, "4 from file": 4}, selected="4 from file")
show_end_effector_frame = BooleanToggle(True)
filter_2 = StreamFilter(
    Gate=list_3,
    Stream0=forward_kinematics_2,
    Stream1=compas_fab_inverse_kinematics,
    Stream2=clean_tree,
    Stream3=plan_motion.trajectories,
    Stream4=from_json)
show_base_frame = BooleanToggle(False)
show_collision = BooleanToggle(False)
show_frames = BooleanToggle(True)
show_visual = BooleanToggle(True)

ghpython_script_8 = GhPythonScript(x=filter_2)  # -> out, a
# ---------- ghpython_script_8: Python ----------
from compas_fab.robots import JointTrajectory

a = x.points if isinstance(x, JointTrajectory) else x
# ---------- end ghpython_script_8 ----------

branch = Slider(0, range=0..1)
tstat = TreeStatistics(Tree=ghpython_script_8.a)  # -> Paths, Length, Count
lng_2 = ListLength(List=flatten(tstat.Paths))  # -> expr("x-1", Length)
remap = RemapNumbers(Value=branch, Source=Domain(0, 1), Target=lng_2)  # -> Mapped, Clipped
item_2 = ListItem(List=flatten(tstat.Paths), Index=remap.Mapped, Wrap=True)

panel_9 = Panel(filter_2)
branch_2 = TreeBranch(Tree=ghpython_script_8.a, Path=item_2, MaintainPaths=True)

item_3 = Slider(1, range=0..1)
lng_3 = ListLength(List=flatten(branch_2))  # -> expr("x-1", Length)
remap_2 = RemapNumbers(Value=item_3, Source=Domain(0, 1), Target=lng_3)  # -> Mapped, Clipped
item_4 = ListItem(List=flatten(branch_2), Index=remap_2.Mapped, Wrap=True)

number_slider_4 = Slider(25, range=0..100)
compas_fab_robot_visualize = COMPASFABRobotVisualize(
    robot=compas_fab_attached_tool,
    group=ghpython_script_4.main_planning_group,
    configuration=item_4,
    show_visual=show_visual,
    show_collision=show_collision,
    show_frames=show_frames,
    show_base_frame=show_base_frame,
    show_end_effector_frame=show_end_effector_frame,
    show_cm=Toggle(True))  # -> visual, collision, collision_meshes, attached_meshes, frames, base_frame, ee_frame; inputs show_visual: Boolean, show_collision: Boolean, show_frames: Boolean, show_base_frame: Boolean, show_end_effector_frame: Boolean, show_cm: Boolean, show_acm: Boolean
#   port group: The planning group used for end-effector and base visualization.
#   port configuration: The robot's full configuration.
#   port show_visual: Whether or not to show the robot's visual meshes.
#   port show_collision: Whether or not to show the robot's collision meshes.
#   port show_frames: Whether or not to show the robot's joint frames.
#   port show_base_frame: Whether or not to show the robot's base frame.
#   port show_end_effector_frame: Whether or not to show the robot's end-effector frame.
#   port show_cm: Whether or not to show the collision meshes (if any).
#   port show_acm: Whether or not to show the attached collision meshes (if any).
#   port visual: Rhino meshes of the robot's visual geometry (if any).
#   port collision: Rhino meshes of the robot's collision geometry (if any).
#   port collision_meshes: Rhino meshes of the scene's collision meshes (if any).
#   port attached_meshes: Rhino meshes of the scene's attached collision meshes (if any).
#   port frames: The robot's joint frames as Rhino planes (if any).
#   port base_frame: The robot's base frame as a Rhino plane (if any).
#   port ee_frame: The robot's end-effector frame as a Rhino plane (if any).
# ---------- compas_fab_robot_visualize: Python ----------
"""
Visualizes the robot.

COMPAS FAB v1.0.2
"""

import time

from compas.geometry import Frame
from compas.geometry import Transformation
from compas.scene import SceneObject
from compas_ghpython import create_id
from compas_rhino.conversions import frame_to_rhino_plane
from ghpythonlib.componentbase import executingcomponent as component
from scriptcontext import sticky as st

from compas_fab.backends import BackendFeatureNotSupportedError
from compas_fab.robots import PlanningScene


class RobotVisualize(component):
    def RunScript(
        self,
        robot,
        group,
        configuration,
        show_visual,
        show_collision,
        show_frames,
        show_base_frame,
        show_end_effector_frame,
        show_cm,
        show_acm,
    ):
        visual = None
        collision = None
        collision_meshes = None
        attached_meshes = None
        frames = None
        base_frame = None
        ee_frame = None

        if robot:
            show_visual = True if show_visual is None else show_visual
            show_cm = True if show_cm is None else show_cm
            show_acm = True if show_acm is None else show_acm
            configuration = configuration or robot.zero_configuration()

            robot.update(configuration, visual=show_visual, collision=show_collision)
            compas_frames = robot.transformed_frames(configuration, group)

            if show_visual:
                visual = robot.scene_object.draw_visual()

            if show_collision:
                collision = robot.scene_object.draw_collision()

            if show_base_frame:
                base_compas_frame = compas_frames[0]
                base_frame = frame_to_rhino_plane(base_compas_frame)

            if show_end_effector_frame:
                options = dict(solver="model")
                if robot.attached_tool:
                    options["link"] = robot.attached_tool.connected_to

                ee_compas_frame = robot.forward_kinematics(configuration, group, options=options)
                ee_frame = frame_to_rhino_plane(ee_compas_frame)

            if show_frames:
                frames = []
                for compas_frame in compas_frames[1:]:
                    frame = frame_to_rhino_plane(compas_frame)
                    frames.append(frame)

            cached_scene_key = create_id(self, "cached_scene")

            if show_cm or show_acm:
                cached_scene = st.get(cached_scene_key)
                if not cached_scene:
                    cached_scene = {"time": 0}

                # expire cache if the component has not been executed in the last 2 seconds
                # this allows to slide through a list of configurations
                # without triggering refreshes of the scene in the middle of it
                if time.time() - cached_scene["time"] > 2:
                    update_scene = True
                else:
                    update_scene = False

                if update_scene:
                    scene = PlanningScene(robot)
                    try:
                        scene = robot.client.get_planning_scene()
                    except BackendFeatureNotSupportedError:
                        print(
                            "The selected backend does not support collision meshes. If you need collision mesh support, use a different backend."
                        )
                        scene = None
                        show_cm = False
                        show_acm = False

                if update_scene and show_cm:
                    collision_meshes = []

                    for co in scene.world.collision_objects:
                        header = co.header
                        frame_id = header.frame_id
                        cms = co.to_collision_meshes()

                        for cm in cms:
                            if cm.frame != Frame.worldXY():
                                t = Transformation.from_frame(cm.frame)
                                mesh = cm.mesh.transformed(t)
                            else:
                                mesh = cm.mesh

                            #collision_meshes.extend(SceneObject(mesh).draw())

                        cached_scene["cm"] = collision_meshes

                collision_meshes = cached_scene.get("cm", [])

                if update_scene and show_acm:
                    attached_meshes = []

                    for aco in scene.robot_state.attached_collision_objects:
                        for acm in aco.to_attached_collision_meshes():
                            frame_id = aco.object["header"]["frame_id"]
                            frame = robot.forward_kinematics(configuration, options=dict(link=frame_id))
                            t = Transformation.from_frame(frame)

                            # Local CM frame
                            if acm.collision_mesh.frame and acm.collision_mesh.frame != Frame.worldXY():
                                t = t * Transformation.from_frame(acm.collision_mesh.frame)

                            mesh = acm.collision_mesh.mesh.transformed(t)

                            attached_meshes.extend(SceneObject(mesh).draw())

                    cached_scene["acm"] = attached_meshes

                attached_meshes = cached_scene.get("acm", [])

                cached_scene["time"] = time.time()
                st[cached_scene_key] = cached_scene

        return (
            visual,
            collision,
            collision_meshes,
            attached_meshes,
            frames,
            base_frame,
            ee_frame,
        )
# ---------- end compas_fab_robot_visualize ----------

# ==== cluster Cluster
plane = ClusterInput()
amplitude = ClusterInput()
R = ClusterInput()
deconstruct_plane = DeconstructPlane(Plane=graft(plane))  # -> Origin, XAxis, YAxis, ZAxis
amplitude_2 = Amplitude(Vector=deconstruct_plane.XAxis, Amplitude=amplitude)
amplitude_3 = Amplitude(Vector=deconstruct_plane.YAxis, Amplitude=amplitude)
amplitude_4 = Amplitude(Vector=deconstruct_plane.ZAxis, Amplitude=amplitude)
move = Move(Geometry=deconstruct_plane.Origin, Motion=amplitude_3)  # -> Geometry, Transform
move_2 = Move(Geometry=deconstruct_plane.Origin, Motion=amplitude_4)  # -> Geometry, Transform
move_3 = Move(Geometry=deconstruct_plane.Origin, Motion=amplitude_2)  # -> Geometry, Transform
ln = Line(StartPoint=deconstruct_plane.Origin, EndPoint=move.Geometry)
ln_2 = Line(StartPoint=deconstruct_plane.Origin, EndPoint=move_3.Geometry)
ln_3 = Line(StartPoint=deconstruct_plane.Origin, EndPoint=move_2.Geometry)
pipe = Pipe(Curve=ln, Radius=R, Caps=0)  # -> simplify(Pipe)
pipe_2 = Pipe(Curve=ln_2, Radius=R, Caps=0)  # -> simplify(Pipe)
pipe_3 = Pipe(Curve=ln_3, Radius=R, Caps=0)  # -> simplify(Pipe)
path_mapper = PathMapper(pipe_2, source="{*}", target="{0}")
path_mapper_2 = PathMapper(ColourSwatch(SwatchColor=RGB(255, 0, 0)), source="{*}", target="{0}")
path_mapper_3 = PathMapper(pipe, source="{*}", target="{1}")
path_mapper_4 = PathMapper(ColourSwatch(SwatchColor=RGB(0, 255, 0)), source="{*}", target="{1}")
path_mapper_5 = PathMapper(ColourSwatch(SwatchColor=RGB(0, 0, 255)), source="{*}", target="{2}")
path_mapper_6 = PathMapper(pipe_3, source="{*}", target="{2}")
data = Data([path_mapper_6, path_mapper_3, path_mapper])
data_2 = Data([path_mapper_5, path_mapper_4, path_mapper_2])
geo = ClusterOutput(data)
color = ClusterOutput(data_2)
