# Grasshopper definition setup_planning_scene.ghx (Grasshopper 1.0.8)
# plug-ins: RhinoCodePluginGH

file_path = FilePath("C:\Users\tetov\Lund University\MAEF, bioDigital Matter & ABM makerspace - General\hardware\bettan\bettan_collision.stl")
ghpython_script = GhPythonScript(stl=file_path)  # -> out, mesh
# ---------- ghpython_script: Python ----------
import math

from compas.datastructures import Mesh
from compas_rhino.conversions import mesh_to_rhino
from compas.geometry import Rotation, Scale, Vector
from compas.colors import Color

mesh = Mesh.from_stl(stl)

#R = Rotation.from_axis_and_angle(Vector.Xaxis(), math.radians(90))
Sc = Scale.from_factors([.001]*3)

mesh = mesh.transformed(Sc)

mesh = mesh_to_rhino(mesh,vertexcolors=[Color.red()]*mesh.number_of_vertices(),color=Color.red())
# ---------- end ghpython_script ----------
# Scene
panel = Panel("platform")
ghpython_script_2 = GhPythonScript(stl=file_path)  # -> out, mesh
# ---------- ghpython_script_2: Python ----------
import math

from compas.datastructures import Mesh
from compas_rhino.conversions import mesh_to_rhino
from compas.geometry import Rotation, Scale, Vector

mesh = Mesh.from_stl(stl)

#R = Rotation.from_axis_and_angle(Vector.Xaxis(), math.radians(90))
Sc = Scale.from_factors([.001]*3)

mesh = mesh.transformed(Sc)

mesh = mesh_to_rhino(mesh)
# ---------- end ghpython_script_2 ----------
compas_fab_collision_mesh = COMPASFABCollisionMesh(mesh=ghpython_script_2.mesh, identifier=panel, add=Button())  # -> ok; inputs mesh: Mesh, add: Boolean, append: Boolean, remove: Boolean
#   port scene: The planning scene.
#   port mesh: A collision mesh.
#   port identifier: The identifier of the collision mesh.
#   port add: If True, adds the collision mesh to the planning scene.
#   port append: If True, appends the collision mesh to the planning scene.
#   port remove: If True, removes the collision mesh from the planning scene.
#   port ok: True if the operation was successfully performed.
# ---------- compas_fab_collision_mesh: Python ----------
"""
Add or remove a collision mesh from the planning scene.

COMPAS FAB v1.0.2
"""

from compas_rhino.conversions import mesh_to_compas
from ghpythonlib.componentbase import executingcomponent as component

from compas_fab.robots import CollisionMesh


class CollisionMeshComponent(component):
    def RunScript(self, scene, M, name, add, append, remove):
        ok = False
        self.Message = ""

        if (add and append) or (append and remove) or (add and remove):
            self.Message = "Use only one operation at a time\n(add, append or remove)"
            raise Exception(self.Message)

        if scene and M and name:
            mesh = mesh_to_compas(M)
            collision_mesh = CollisionMesh(mesh, name)
            if add:
                scene.add_collision_mesh(collision_mesh)
                self.Message = "Added"
                ok = True
            if append:
                scene.append_collision_mesh(collision_mesh)
                self.Message = "Appended"
                ok = True
            if remove:
                scene.remove_collision_mesh(name)
                self.Message = "Removed"
                ok = True
        return ok
# ---------- end compas_fab_collision_mesh ----------
ironpython_2_script = IronPython2Script(stl=file_path, name="platform")  # -> out, mesh, rmesh, cm
# ---------- ironpython_2_script: IronPython ----------
import math

from compas.datastructures import Mesh
from compas_rhino.conversions import mesh_to_rhino
from compas.geometry import Rotation, Scale, Vector
from compas_fab.robots import CollisionMesh

mesh = Mesh.from_stl(stl)

Sc = Scale.from_factors([.001]*3)

mesh = mesh.transformed(Sc)

rmesh = mesh_to_rhino(mesh)

cm = CollisionMesh(mesh, name)
# ---------- end ironpython_2_script ----------
