# Grasshopper definition view_pointcloud_in_gh.gh (Grasshopper 1.0.8)
# plug-ins: RhinoCodePluginGH

panel = Panel("C:\Users\mangliar\Documents\GitHub\bdm_voxel_builder\temp\2024-08-07_11_17_17_test_config_slice_i1000a1_a1_i1000_pointcloud.json")
reload = Button()

import_and_sort_pts = IronPython2Script(filename=panel, reset=reload)  # -> out, pts, values, json_data; inputs filename: String, reset: Boolean
# ---------- import_and_sort_pts: IronPython ----------
import os
import json
from ghpythonlib.treehelpers import list_to_tree
from ghpythonlib.components import SortList

with open(filename, 'r') as f:
    json_data = json.load(f)

pointcloud = json_data['pointcloud']

pts = pointcloud['data']['points']
values = json_data['values']

values, pts = SortList(values, pts)
pts = list_to_tree(pts)
# ---------- end import_and_sort_pts ----------
panel_2 = Panel(import_and_sort_pts.values)
panel_3 = Panel(import_and_sort_pts.pts)

dam = DataDam(DataA=import_and_sort_pts.pts, BufferDelay=10000000, BufferMode=2)
item = ListItem(List=dam, Index=0, Wrap=True)  # -> Item, Item1, Item2
pt = ConstructPoint(XCoordinate=item.Item, YCoordinate=item.Item1, ZCoordinate=item.Item2)  # -> flatten(Point)
pcloud = PointCloud(pt)

swatch = ColourSwatch(SwatchColor=RGBA(255, 255, 255, 237))

list = ValueList({"show voxel cubes": 0, "show as printed dots": 1, "show rotated voxel cubes": 2}, selected="show as printed dots")
show_partially = Slider(1, range=0..1)

lng = ListLength(List=panel_2)
multiplication = Multiplication(A=lng, B=show_partially)

point_count = Panel(lng)

# ---- group: remap color
split = SplitList(List=panel_2, Index=multiplication)  # -> ListA, ListB
num = Number(split.ListA)
bnd = Bounds(Numbers=num)
dedomain = DeconstructDomain(Domain=bnd)  # -> Start, End
division = Division(A=dedomain.End, B=Slider(1000, range=0..1000))
dom = ConstructDomain(DomainStart=dedomain.Start, DomainEnd=division)
remap = RemapNumbers(Value=num, Source=bnd, Target="100 to 255")  # -> Mapped, Clipped
remap_2 = RemapNumbers(Value=remap.Mapped, Source="0 to 1", Target=Domain(0, 1))  # -> Mapped, Clipped
multiplication_2 = Multiplication(A=remap.Mapped, B=Slider(0.55, range=0..1))
multiplication_3 = Multiplication(A=remap.Mapped)
multiplication_4 = Multiplication(A=remap.Mapped)
rgb = ColourRGB(Alpha=255, Red=multiplication_2, Green=remap.Mapped, Blue=remap.Mapped)

# ----
split_2 = SplitList(List=pt, Index=multiplication)  # -> ListA, ListB
gate = StreamGate(Stream=split_2.ListA, Gate=list)  # -> Target0, Target1, Target2

xy = XYPlane(Origin=Point(0, 0, 0))
rotate = Rotate(Geometry=xy, Angle=degrees("45"), Plane=PlaneXY(0, 0, 0))  # -> Geometry, Transform
number_slider = Slider(0.7, range=0..1)
number_slider_2 = Slider(1, range=0..1)
number_slider_3 = Slider(1, range=0..10)
box = CenterBox(Base=rotate.Geometry, X=number_slider, Y=number_slider, Z=Slider(0.5, range=0..1))
mbox = MeshBox(Base=box, XCount=number_slider_2, YCount=number_slider_2, ZCount=number_slider_2)
move = Move(Motion=gate.Target2)  # -> Geometry, Transform
transform = Transform(Geometry=mbox, Transform=move.Transform)
swatch_2 = ColourSwatch(SwatchColor=RGBA(255, 255, 255, 176))
preview = CustomPreview(Geometry=transform, Material=rgb)

msphereex = MeshSphereEx(Base=PlaneXY(0, 0, 0), Radius=Slider(1, range=0..1), Count=Slider(3, range=0..10))
scale_nu = ScaleNU(Geometry=msphereex, Plane=PlaneXY(0, 0, 0), ScaleX=1, ScaleY=1, ScaleZ=Slider(0.8, range=0..1))  # -> Geometry, Transform
transform_2 = Transform(Geometry=scale_nu.Geometry, Transform=gate.Target1)
swatch_3 = ColourSwatch(SwatchColor=RGBA(209, 198, 96, 237))
preview_2 = CustomPreview(Geometry=transform_2, Material=rgb)

number_slider_4 = Slider(0.5, range=0..1)
number_slider_5 = Slider(1, range=0..1)
number_slider_6 = Slider(1, range=0..10)
box_2 = CenterBox(Base=PlaneXY(0, 0, 0), X=number_slider_4, Y=number_slider_4, Z=number_slider_4)
move_2 = Move(Motion=gate.Target0)  # -> Geometry, Transform
mbox_2 = MeshBox(Base=box_2, XCount=number_slider_5, YCount=number_slider_5, ZCount=number_slider_5)
swatch_4 = ColourSwatch(SwatchColor=RGBA(209, 96, 187, 237))
transform_3 = Transform(Geometry=mbox_2, Transform=move_2.Transform)
preview_3 = CustomPreview(Geometry=transform_3, Material=rgb)
