# Grasshopper definition view_pointcloud_in_gh_2 - Copy.gh (Grasshopper 1.0.8)
# plug-ins: RhinoCodePluginGH

path = FilePath("C:\Users\mangliar\Documents\GitHub\bdm_voxel_builder\temp\pointclouds\2024-09-03_12_20_27_algo_12_random_builder_4small_1big_no_reset_i2000a5_a5_i2000_pointcloud.json")
panel = Panel(path)
reload = Button()

# ---- group: temp/pointclouds
path_2 = FilePath("C:\Users\mangliar\Documents\GitHub\bdm_voxel_builder\temp\pointclouds\")

# ----
import_and_sort_pts = IronPython2Script(folder=path_2, nth=Slider(10, range=0..10), reset=reload)  # -> out, filename; inputs folder: String, nth: Int32, reset: Boolean
# ---------- import_and_sort_pts: IronPython ----------
import os
from compas.colors import Color
from compas.geometry import Pointcloud
import json
from ghpythonlib.treehelpers import list_to_tree

def get_nth_newest_file_in_folder(folder_path, n = 0):
    try:
        # Get a list of files in the folder
        files = [os.path.join(folder_path, filename) for filename in os.listdir(folder_path)]

        # Sort the files by change time (modification time) in descending order
        files.sort(key=lambda x: os.path.getmtime(x), reverse=True)

        # Return the newest file
        if files:
            return files[min(n, len(files))]
        else:
            print("Folder is empty.")
            return None
    except Exception as e:
        print(e)
        return None
if reset:
    pass

# params
Nth = nth
print(folder)
filename = get_nth_newest_file_in_folder(folder, Nth)
print(filename)
# ---------- end import_and_sort_pts ----------
path_3 = FilePath(import_and_sort_pts.filename)
list = ValueList({"mono_color": 0, "gradient": 1}, selected="gradient")
path_4 = FilePath("C:\Users\mangliar\Documents\GitHub\bdm_voxel_builder\temp\pointclouds\2024-09-05_19_15_37_algo_15_i1000a10_a10_i1000_pointcloud.json")

# ---- group: file from temp
path_5 = FilePath("C:\Users\mangliar\Documents\GitHub\bdm_voxel_builder\temp\pointclouds\2024-09-05_17_30_29_algo_14_density_range_i5000a15_a15_i5000_pointcloud.json")

# ----
path_6 = FilePath("C:\Users\mangliar\Documents\GitHub\bdm_voxel_builder\temp\pointclouds\2024-09-03_19_42_51_algo_13_density_i800a15_a15_i800_pointcloud.json")
panel_2 = Panel(path_6)
reload_2 = Button()
import_and_sort_pts_2 = IronPython2Script(filename=path_6, reset=reload_2)  # -> out, pts, values, json_data; inputs filename: String, reset: Boolean
# ---------- import_and_sort_pts_2: IronPython ----------
import os
import json
from ghpythonlib.treehelpers import list_to_tree
from ghpythonlib.components import SortList

with open(filename, 'r') as f:
    json_data = json.load(f)

pointcloud = json_data['pointcloud']

pts = pointcloud['data']['points']
values = json_data['values']

values, pts = SortList(values, pts)
pts = list_to_tree(pts)
# ---------- end import_and_sort_pts_2 ----------
panel_3 = Panel(import_and_sort_pts_2.pts)

dam = DataDam(DataA=import_and_sort_pts_2.pts, BufferDelay=10000000, BufferMode=2)
item = ListItem(List=dam, Index=0, Wrap=True)  # -> Item, Item1, Item2
pt = ConstructPoint(XCoordinate=item.Item, YCoordinate=item.Item1, ZCoordinate=item.Item2)  # -> flatten(Point)

split = SplitList(List=pt, Index=Slider(200, range=0..1000))  # -> ListA, ListB

show_partially = Slider(0.3016, range=0..1)
list_2 = ValueList({"show voxel cubes": 0, "show voxel subd cubes": 1, "show as printed dots": 2, "show as points": 3}, selected="show voxel cubes")

pln = Plane(pt)

lng = ListLength(List=pln)
multiplication = Multiplication(A=lng, B=show_partially)

point_count = Panel(lng)

split_2 = SplitList(List=pln, Index=multiplication)  # -> ListA, ListB

# ---- group: remap color
lng_2 = ListLength(List=split_2.ListA)
range = Range(Domain=Domain(0, 1), Steps=lng_2)
num = Number(range)
bnd = Bounds(Numbers=num)
remap = RemapNumbers(Value=num, Source=bnd, Target="100 to 255")  # -> Mapped, Clipped
remap_2 = RemapNumbers(Value=remap.Mapped, Source="0 to 1", Target=Domain(0, 1))  # -> Mapped, Clipped
multiplication_2 = Multiplication(A=remap.Mapped, B=Slider(0.55, range=0..1))
rgb = ColourRGB(Alpha=255, Red=multiplication_2, Green=multiplication_2, Blue=remap.Mapped)

# ----
gate = StreamGate(Stream=split_2.ListA, Gate=list_2)  # -> Target0, Target1, Target2, Target3

xy = XYPlane(Origin=Point(0, 0, 0))
box = CenterBox(Base=xy, X="0.5", Y="0.5", Z="0.5")
mbox = MeshBox(Base=box, XCount="1", YCount="1", ZCount="1")
orient = Orient(Geometry=mbox, Source=xy, Target=gate.Target0)  # -> Geometry, Transform

number_slider = Slider(0.59, range=0..1)
xy_2 = XYPlane(Origin=Point(0, 0, 0))
number_slider_2 = Slider(2, range=0..10)
box_2 = CenterBox(Base=xy_2, X=number_slider, Y=number_slider, Z=number_slider)
mbox_2 = MeshBox(Base=box_2, XCount=number_slider_2, YCount=number_slider_2, ZCount=number_slider_2)
subdmesh = SubDFromMesh(Mesh=mbox_2, Creases=1, Corners=1, Interpolate=False)
meshsubd = MeshFromSubD(SubD=subdmesh, Density=Slider(1, range=0..1))
orient_2 = Orient(Geometry=meshsubd, Source=xy, Target=gate.Target1)  # -> Geometry, Transform

pt_2 = Point(gate.Target3)
filter = StreamFilter(Gate=list, Stream0=ColourSwatch(SwatchColor=RGB(166, 222, 177)), Stream1=rgb)

rad = Number()  # disabled
layer_h = Number()  # disabled
number_slider_3 = Slider(2, range=0..10)  # disabled
xy_3 = XYPlane(Origin=Point(0, 0, 0))  # disabled
division = Division(A=layer_h, B=number_slider_3)  # disabled
pl_offset = PlaneOffset(BasePlane=gate.Target2, Offset=division)  # disabled
division_2 = Division(A=division, B=rad)  # disabled
msphereex = MeshSphereEx(Base=xy_3, Radius=rad, Count=5)  # disabled

multiplication_3 = Multiplication(A=division_2, B=1.2)  # disabled

scale_nu = ScaleNU(Geometry=msphereex, Plane=xy_3, ScaleX=1, ScaleY=1, ScaleZ=multiplication_3)  # -> Geometry, Transform; disabled
orient_3 = Orient(Geometry=scale_nu.Geometry, Source=xy_3, Target=pl_offset)  # -> Geometry, Transform; disabled

filter_2 = StreamFilter(Gate=list_2, Stream0=orient.Geometry, Stream1=orient_2.Geometry, Stream2=orient_3.Geometry, Stream3=pt_2)

preview = CustomPreview(Geometry=filter_2, Material=filter)
