# Grasshopper definition view_pointcloud_in_gh_2.gh (Grasshopper 1.0.8)
# plug-ins: RhinoCodePluginGH

path = FilePath("C:\Users\mangliar\Documents\GitHub\bdm_voxel_builder\temp\pointclouds\2024-09-03_12_20_27_algo_12_random_builder_4small_1big_no_reset_i2000a5_a5_i2000_pointcloud.json")
panel = Panel(path)
reload = Button()

# ---- group: temp/pointclouds
path_2 = FilePath("C:\Users\mangliar\Documents\GitHub\bdm_voxel_builder\temp\pointclouds\")

# ----
import_and_sort_pts = IronPython2Script(folder=path_2, nth=Slider(0, range=0..10), reset=reload)  # -> out, filename; inputs folder: String, nth: Int32, reset: Boolean
# ---------- import_and_sort_pts: IronPython ----------
import os
from compas.colors import Color
from compas.geometry import Pointcloud
import json
from ghpythonlib.treehelpers import list_to_tree

def get_nth_newest_file_in_folder(folder_path, n = 0):
    try:
        # Get a list of files in the folder
        files = [os.path.join(folder_path, filename) for filename in os.listdir(folder_path)]

        # Sort the files by change time (modification time) in descending order
        files.sort(key=lambda x: os.path.getmtime(x), reverse=True)

        # Return the newest file
        if files:
            return files[min(n, len(files))]
        else:
            print("Folder is empty.")
            return None
    except Exception as e:
        print(e)
        return None
if reset:
    pass

# params
Nth = nth
print(folder)
filename = get_nth_newest_file_in_folder(folder, Nth)
print(filename)
# ---------- end import_and_sort_pts ----------
path_3 = FilePath(import_and_sort_pts.filename)
panel_2 = Panel(path_3)

# ---- group: file from temp
path_4 = FilePath("C:\Users\mangliar\Documents\GitHub\bdm_voxel_builder\temp\pointclouds\2024-09-03_12_14_47_algo_12_random_builder_4small_1big_no_reset_i2000a5_a5_i2000_pointcloud.json")

# ----
reload_2 = Button()
import_and_sort_pts_2 = IronPython2Script(filename=panel_2, reset=reload_2)  # -> out, pts, values, json_data; inputs filename: String, reset: Boolean
# ---------- import_and_sort_pts_2: IronPython ----------
import os
import json
from ghpythonlib.treehelpers import list_to_tree
from ghpythonlib.components import SortList

with open(filename, 'r') as f:
    json_data = json.load(f)

pointcloud = json_data['pointcloud']

pts = pointcloud['data']['points']
values = json_data['values']

values, pts = SortList(values, pts)
pts = list_to_tree(pts)
# ---------- end import_and_sort_pts_2 ----------
panel_3 = Panel(import_and_sort_pts_2.pts)

dam = DataDam(DataA=import_and_sort_pts_2.pts, BufferDelay=10000000, BufferMode=2)
item = ListItem(List=dam, Index=0, Wrap=True)  # -> Item, Item1, Item2
pt = ConstructPoint(XCoordinate=item.Item, YCoordinate=item.Item1, ZCoordinate=item.Item2)  # -> flatten(Point)

split = SplitList(List=pt, Index=Slider(200, range=0..1000))  # -> ListA, ListB

show_partially = Slider(1, range=0..1)
list = ValueList({"show voxel cubes": 0, "show as printed dots": 1, "show as points": 2}, selected="show voxel cubes")

pln = Plane(pt)

lng = ListLength(List=pln)
multiplication = Multiplication(A=lng, B=show_partially)

point_count = Panel(lng)

split_2 = SplitList(List=pln, Index=multiplication)  # -> ListA, ListB

# ---- group: remap color
lng_2 = ListLength(List=split_2.ListA)
range = Range(Domain=Domain(0, 1), Steps=lng_2)
num = Number(range)
bnd = Bounds(Numbers=num)
remap = RemapNumbers(Value=num, Source=bnd, Target="100 to 255")  # -> Mapped, Clipped
remap_2 = RemapNumbers(Value=remap.Mapped, Source="0 to 1", Target=Domain(0, 1))  # -> Mapped, Clipped
multiplication_2 = Multiplication(A=remap.Mapped, B=Slider(0.55, range=0..1))
rgb = ColourRGB(Alpha=255, Red=multiplication_2, Green=remap.Mapped, Blue=remap.Mapped)

# ----
gate = StreamGate(Stream=split_2.ListA, Gate=list)  # -> Target0, Target1, Target2

xy = XYPlane(Origin=Point(0, 0, 0))
box = CenterBox(Base=xy, X="1", Y="1", Z="1")
mbox = MeshBox(Base=box, XCount="1", YCount="1", ZCount="1")
orient = Orient(Geometry=mbox, Source=xy, Target=gate.Target0)  # -> Geometry, Transform

pt_2 = Point(gate.Target2)

rad = Number()  # disabled
layer_h = Number()  # disabled
number_slider = Slider(2, range=0..10)  # disabled
xy_2 = XYPlane(Origin=Point(0, 0, 0))  # disabled
division = Division(A=layer_h, B=number_slider)  # disabled
pl_offset = PlaneOffset(BasePlane=gate.Target1, Offset=division)  # disabled
division_2 = Division(A=division, B=rad)  # disabled
msphereex = MeshSphereEx(Base=xy_2, Radius=rad, Count=5)  # disabled

multiplication_3 = Multiplication(A=division_2, B=1.2)  # disabled

scale_nu = ScaleNU(Geometry=msphereex, Plane=xy_2, ScaleX=1, ScaleY=1, ScaleZ=multiplication_3)  # -> Geometry, Transform; disabled
orient_2 = Orient(Geometry=scale_nu.Geometry, Source=xy_2, Target=pl_offset)  # -> Geometry, Transform; disabled

filter = StreamFilter(Gate=list, Stream0=orient.Geometry, Stream1=orient_2.Geometry, Stream2=pt_2)

preview = CustomPreview(Geometry=filter, Material=rgb)
