# Grasshopper definition view_pointcloud_in_gh_b.gh (Grasshopper 1.0.8)
# plug-ins: RhinoCodePluginGH

path = FilePath("C:\Users\mangliar\Documents\GitHub\bdm_voxel_builder\docs\algo_10_slicer\")
path_2 = FilePath("C:\Users\mangliar\Documents\GitHub\bdm_voxel_builder\temp\pointclouds\")

folder = Panel(path_2)
reload = Button()
import_and_sort_pts = IronPython2Script(folder=folder, nth=Slider(0, range=0..10), reset=reload)  # -> out, filename; inputs folder: String, nth: Int32, reset: Boolean
# ---------- import_and_sort_pts: IronPython ----------
import os
from compas.colors import Color
from compas.geometry import Pointcloud
import json
from ghpythonlib.treehelpers import list_to_tree

def get_nth_newest_file_in_folder(folder_path, n = 0):
    try:
        # Get a list of files in the folder
        files = [os.path.join(folder_path, filename) for filename in os.listdir(folder_path)]

        # Sort the files by change time (modification time) in descending order
        files.sort(key=lambda x: os.path.getmtime(x), reverse=True)

        # Return the newest file
        if files:
            return files[min(n, len(files))]
        else:
            print("Folder is empty.")
            return None
    except Exception as e:
        print(e)
        return None
if reset:
    pass

# params
Nth = nth
print(folder)
filename = get_nth_newest_file_in_folder(folder, Nth)
print(filename)
# ---------- end import_and_sort_pts ----------

path_3 = FilePath(import_and_sort_pts.filename)
panel = Panel(path_3)

# ---- group: specimen-1
path_4 = FilePath("C:\Users\mangliar\Documents\GitHub\bdm_voxel_builder\temp\pointclouds\2024-08-20_13_26_22_test_config_slice_b_i100a1_a1_i100_pointcloud.json")
panel_2 = Panel(path_4)

# ----
reload_2 = Button()

import_and_sort_pts_2 = IronPython2Script(filename=panel, reset=reload_2)  # -> out, pts, values, json_data; inputs filename: String, reset: Boolean
# ---------- import_and_sort_pts_2: IronPython ----------
import os
import json
from ghpythonlib.treehelpers import list_to_tree
from ghpythonlib.components import SortList

with open(filename, 'r') as f:
    json_data = json.load(f)

pointcloud = json_data['pointcloud']

pts = pointcloud['data']['points']
values = json_data['values']

values, pts = SortList(values, pts)
pts = list_to_tree(pts)
# ---------- end import_and_sort_pts_2 ----------
panel_3 = Panel(import_and_sort_pts_2.values)
panel_4 = Panel(import_and_sort_pts_2.pts)

dam = DataDam(DataA=import_and_sort_pts_2.pts, BufferDelay=10000000, BufferMode=2)
item = ListItem(List=dam, Index=0, Wrap=True)  # -> Item, Item1, Item2
pt = ConstructPoint(XCoordinate=item.Item, YCoordinate=item.Item1, ZCoordinate=item.Item2)  # -> flatten(Point)

number_slider = Slider(1, range=0..1)
number_slider_2 = Slider(0.5, range=0..1)

pt_2 = Point(pt)
dot_distance = Number(number_slider_2)
layer_h = Number(number_slider_2)
scale_nu = ScaleNU(Geometry=pt_2, Plane=PlaneXY(0, 0, 0), ScaleX=dot_distance, ScaleY=dot_distance, ScaleZ=layer_h)  # -> Geometry, Transform

number_slider_3 = Slider(0.8, range=0..1)

show_partially = Slider(1, range=0..1)
list = ValueList({"show voxel cubes": 0, "show as printed dots": 1, "show rotated voxel cubes": 2}, selected="show voxel cubes")

lng = ListLength(List=panel_3)
multiplication = Multiplication(A=lng, B=show_partially)

point_count = Panel(lng)

# ---- group: remap color
split = SplitList(List=panel_3, Index=multiplication)  # -> ListA, ListB
num = Number(split.ListA)
bnd = Bounds(Numbers=num)
dedomain = DeconstructDomain(Domain=bnd)  # -> Start, End
division = Division(A=dedomain.End, B=Slider(1000, range=0..1000))
dom = ConstructDomain(DomainStart=dedomain.Start, DomainEnd=division)
remap = RemapNumbers(Value=num, Source=bnd, Target="100 to 255")  # -> Mapped, Clipped
remap_2 = RemapNumbers(Value=remap.Mapped, Source="0 to 1", Target=Domain(0, 1))  # -> Mapped, Clipped
multiplication_2 = Multiplication(A=remap.Mapped, B=Slider(0.55, range=0..1))
multiplication_3 = Multiplication(A=remap.Mapped)
multiplication_4 = Multiplication(A=remap.Mapped)
rgb = ColourRGB(Alpha=255, Red=multiplication_2, Green=remap.Mapped, Blue=remap.Mapped)

# ----
split_2 = SplitList(List=scale_nu.Geometry, Index=multiplication)  # -> ListA, ListB
gate = StreamGate(Stream=split_2.ListA, Gate=list)  # -> Target0, Target1, Target2

subtraction = Subtraction(A=lng, B=Slider(8, range=0..10))
num_2 = Number(Slider(0.25, range=0..1))
num_3 = Number(layer_h)
division_2 = Division(A=num_3, B=2)

multiplication_5 = Multiplication(A=num_2, B=Slider(2.5, range=0..10))

division_3 = Division(A=multiplication_5, B=2)
multiplication_6 = Multiplication(A=Slider(1, range=0..10), B=division_3, C=Slider(2.5, range=0..10))

number_slider_4 = Slider(1, range=0..1)
box = CenterBox(Base=PlaneXY(0, 0, 0), X=num_2, Y=num_2, Z=num_2)
move = Move(Motion=gate.Target0)  # -> Geometry, Transform
mbox = MeshBox(Base=box, XCount=number_slider_4, YCount=number_slider_4, ZCount=number_slider_4)
swatch = ColourSwatch(SwatchColor=RGBA(209, 96, 187, 237))
transform = Transform(Geometry=mbox, Transform=move.Transform)
preview = CustomPreview(Geometry=transform, Material=rgb)

cir = Circle(Plane=PlaneXY(0, 0, 0), Radius=multiplication_6)
transform_2 = Transform(Geometry=cir, Transform=gate.Target1)

xy = XYPlane(Origin=Point(0, 0, 0))
number_slider_5 = Slider(1.4, range=0..10)
rotate = Rotate(Geometry=xy, Angle=degrees("45"), Plane=PlaneXY(0, 0, 0))  # -> Geometry, Transform
transform_3 = Transform(Geometry=mbox, Transform=rotate.Transform)
move_2 = Move(Motion=gate.Target2)  # -> Geometry, Transform
swatch_2 = ColourSwatch(SwatchColor=RGBA(255, 255, 255, 237))

number_slider_6 = Slider(0.2, range=0..1)
msphereex = MeshSphereEx(Base=PlaneXY(0, 0, 0), Radius=multiplication_6, Count=5)
scale_nu_2 = ScaleNU(Geometry=msphereex, Plane=PlaneXY(0, 0, 0), ScaleX=1, ScaleY=1, ScaleZ=number_slider_6)  # -> Geometry, Transform
transform_4 = Transform(Geometry=scale_nu_2.Geometry, Transform=gate.Target1)
swatch_3 = ColourSwatch(SwatchColor=RGBA(209, 198, 96, 237))

scale_nu_3 = ScaleNU(Plane=PlaneXY(0, 0, 0), ScaleX=number_slider_5, ScaleY=number_slider_5, ScaleZ=number_slider_6)  # -> Geometry, Transform
transform_5 = Transform(Geometry=transform_3, Transform=scale_nu_3.Transform)
transform_6 = Transform(Geometry=transform_5, Transform=move_2.Transform)
preview_2 = CustomPreview(Geometry=transform_6, Material=rgb)

scale_nu_4 = ScaleNU(Geometry=msphereex, Plane=PlaneXY(0, 0, 0), ScaleX=1, ScaleY=1, ScaleZ=Slider(2, range=0..10))  # -> Geometry, Transform
transform_7 = Transform(Geometry=transform_4, Transform=scale_nu_4.Transform)

# ----
# design input
preview_3 = CustomPreview(Geometry=transform_7, Material=rgb)
