# Grasshopper definition visualize_conf_trajectory.ghx (Grasshopper 1.0.8)

file_path = FilePath("C:\Users\tetov\bdm_voxel_builder\temp\confs.json")
compas_fab_ros_connect = COMPASFABROSConnect(connect=Toggle(True))  # -> ros_client, is_connected; inputs port: Int32, connect: Boolean
#   port ip: The ip address ROS. Defaults to 127.0.0.1.
#   port port: The port of ROS. Defaults to 9090.
#   port connect: If True, connects to ROS. If False, disconnects from ROS. Defaults to False.
#   port ros_client: The ROS client.
#   port is_connected: True if connection established.
# ---------- compas_fab_ros_connect: Python ----------
"""
Connect or disconnect to ROS.

COMPAS FAB v1.0.2
"""

from ghpythonlib.componentbase import executingcomponent as component
from scriptcontext import sticky as st

from compas_fab.backends import RosClient
from compas_fab.ghpython.components import create_id


class ROSConnect(component):
    def RunScript(self, ip, port, connect):
        ros_client = None

        ip = ip or "127.0.0.1"
        port = port or 9090

        key = create_id(self, "ros_client")
        ros_client = st.get(key, None)

        if ros_client:
            st[key].close()
        if connect:
            st[key] = RosClient(ip, port)
            st[key].run(5)

        ros_client = st.get(key, None)
        is_connected = ros_client.is_connected if ros_client else False
        return (ros_client, is_connected)
# ---------- end compas_fab_ros_connect ----------
from_json = FromJSON(json=file_path)  # -> result
#   port json: JSON file path or JSON string.
#   port result: Deserialized objects.
# ---------- from_json: Python ----------
"""
Deserializes JSON into COMPAS objects.
"""

from ghpythonlib.componentbase import executingcomponent as component

import compas


class CompasInfo(component):
    def RunScript(self, json):
        if not json:
            return None

        try:
            return compas.json_load(json)
        except:  # noqa: E722
            return compas.json_loads(json)
# ---------- end from_json ----------
list_item = ListItem(List=from_json, Index=Slider(260, range=0..1000), Wrap=False)
compas_fab_ros_robot = COMPASFABROSRobot(ros_client=compas_fab_ros_connect.ros_client, load=Toggle(True))  # -> robot; inputs load: Boolean
#   port ros_client: The ROS client.
#   port load: If True, loads the robot from ROS. Defaults to False.
# ---------- compas_fab_ros_robot: Python ----------
"""
Load robot directly from ROS.

COMPAS FAB v1.0.2
"""

from compas.scene import SceneObject
from ghpythonlib.componentbase import executingcomponent as component
from scriptcontext import sticky as st
import compas_ghpython.drawing
from compas_fab.ghpython.components import create_id

class ROSRobot(component):
    def RunScript(self, ros_client, load):
        key = create_id(self, "robot")

        if ros_client and ros_client.is_connected and load:
            # Load URDF from ROS
            st[key] = ros_client.load_robot(load_geometry=True, precision=12)
            st[key].scene_object = SceneObject(st[key].model)

        robot = st.get(key, None)
        if robot:  # client sometimes need to be restarted, without needing to reload geometry
            robot.client = ros_client
        return robot
# ---------- end compas_fab_ros_robot ----------
compas_fab_ros_robot_2 = COMPASFABROSRobot(ros_client=compas_fab_ros_connect.ros_client, load=Button())  # -> robot; inputs load: Boolean
#   port ros_client: The ROS client.
#   port load: If True, loads the robot from ROS. Defaults to False.
# ---------- compas_fab_ros_robot_2: Python ----------
"""
Load robot directly from ROS.

COMPAS FAB v1.0.2
"""

from compas.scene import SceneObject
from ghpythonlib.componentbase import executingcomponent as component
from scriptcontext import sticky as st

from compas_fab.ghpython.components import create_id


class ROSRobot(component):
    def RunScript(self, ros_client, load):
        key = create_id(self, "robot")

        if ros_client and ros_client.is_connected and load:
            # Load URDF from ROS
            st[key] = ros_client.load_robot(load_geometry=True, precision=12)
            st[key].scene_object = SceneObject(st[key].model)

        robot = st.get(key, None)
        if robot:  # client sometimes need to be restarted, without needing to reload geometry
            robot.client = ros_client
        return robot
# ---------- end compas_fab_ros_robot_2 ----------
compas_fab_trajectory_visualize = COMPASFABTrajectoryVisualize(robot=compas_fab_ros_robot_2)  # -> start_configuration, configurations, fraction, time, planes, P, V, A
#   port group: The planning group for which this trajectory was planned.
#   port trajectory: The calculated trajectory.
#   port start_configuration: The start configuration of the trajectory.
#   port configurations: The full configurations along the trajectory.
#   port fraction: Indicates the fraction of requested trajectory that was calculated, e.g. 1 means the full trajectory was found.
#   port time: The time which is needed to execute that trajectory at full speed.
#   port planes: The planes of the robot's end-effector.
#   port P: The positions along the trajectory
#   port V: The velocities along the trajectory
#   port A: The accelerations along the trajectory
# ---------- compas_fab_trajectory_visualize: Python ----------
"""
Visualizes a trajectory.

COMPAS FAB v1.0.2
"""

from compas_ghpython import draw_frame
from compas_ghpython.sets import list_to_ghtree
from ghpythonlib.componentbase import executingcomponent as component


class TrajectoryVisualize(component):
    def RunScript(self, robot, group, trajectory):
        start_configuration = None
        configurations = []
        fraction = 0.0
        time = 0.0

        planes = []
        positions = []
        velocities = []
        accelerations = []

        if robot and trajectory:
            group = group or robot.main_group_name

            for c in trajectory.points:
                configurations.append(
                    robot.merge_group_with_full_configuration(c, trajectory.start_configuration, group)
                )
                frame = robot.forward_kinematics(c, group, options=dict(solver="model"))
                planes.append(draw_frame(frame))
                positions.append(c.positions)
                velocities.append(c.velocities)
                accelerations.append(c.accelerations)

            start_configuration = trajectory.start_configuration
            fraction = trajectory.fraction
            time = trajectory.time_from_start

        P = list_to_ghtree(list(zip(*positions)))
        V = list_to_ghtree(list(zip(*velocities)))
        A = list_to_ghtree(list(zip(*accelerations)))

        # return outputs if you have them; here I try it for you:
        return (start_configuration, configurations, fraction, time, planes, P, V, A)
# ---------- end compas_fab_trajectory_visualize ----------
compas_fab_robot_visualize = COMPASFABRobotVisualize(robot=compas_fab_ros_robot_2, configuration=list_item)  # -> visual, collision, collision_meshes, attached_meshes, frames, base_frame, ee_frame; inputs show_visual: Boolean, show_collision: Boolean, show_frames: Boolean, show_base_frame: Boolean, show_end_effector_frame: Boolean, show_cm: Boolean, show_acm: Boolean
#   port group: The planning group used for end-effector and base visualization.
#   port configuration: The robot's full configuration.
#   port show_visual: Whether or not to show the robot's visual meshes.
#   port show_collision: Whether or not to show the robot's collision meshes.
#   port show_frames: Whether or not to show the robot's joint frames.
#   port show_base_frame: Whether or not to show the robot's base frame.
#   port show_end_effector_frame: Whether or not to show the robot's end-effector frame.
#   port show_cm: Whether or not to show the collision meshes (if any).
#   port show_acm: Whether or not to show the attached collision meshes (if any).
#   port visual: Rhino meshes of the robot's visual geometry (if any).
#   port collision: Rhino meshes of the robot's collision geometry (if any).
#   port collision_meshes: Rhino meshes of the scene's collision meshes (if any).
#   port attached_meshes: Rhino meshes of the scene's attached collision meshes (if any).
#   port frames: The robot's joint frames as Rhino planes (if any).
#   port base_frame: The robot's base frame as a Rhino plane (if any).
#   port ee_frame: The robot's end-effector frame as a Rhino plane (if any).
# ---------- compas_fab_robot_visualize: Python ----------
"""
Visualizes the robot.

COMPAS FAB v1.0.2
"""

import time

from compas.geometry import Frame
from compas.geometry import Transformation
from compas.scene import SceneObject
from compas_ghpython import create_id
from compas_rhino.conversions import frame_to_rhino_plane
from ghpythonlib.componentbase import executingcomponent as component
from scriptcontext import sticky as st

from compas_fab.backends import BackendFeatureNotSupportedError
from compas_fab.robots import PlanningScene


class RobotVisualize(component):
    def RunScript(
        self,
        robot,
        group,
        configuration,
        show_visual,
        show_collision,
        show_frames,
        show_base_frame,
        show_end_effector_frame,
        show_cm,
        show_acm,
    ):
        visual = None
        collision = None
        collision_meshes = None
        attached_meshes = None
        frames = None
        base_frame = None
        ee_frame = None

        if robot:
            show_visual = True if show_visual is None else show_visual
            show_cm = True if show_cm is None else show_cm
            show_acm = True if show_acm is None else show_acm
            configuration = configuration or robot.zero_configuration()

            robot.update(configuration, visual=show_visual, collision=show_collision)
            compas_frames = robot.transformed_frames(configuration, group)

            if show_visual:
                visual = robot.scene_object.draw_visual()

            if show_collision:
                collision = robot.scene_object.draw_collision()

            if show_base_frame:
                base_compas_frame = compas_frames[0]
                base_frame = frame_to_rhino_plane(base_compas_frame)

            if show_end_effector_frame:
                options = dict(solver="model")
                if robot.attached_tool:
                    options["link"] = robot.attached_tool.connected_to

                ee_compas_frame = robot.forward_kinematics(configuration, group, options=options)
                ee_frame = frame_to_rhino_plane(ee_compas_frame)

            if show_frames:
                frames = []
                for compas_frame in compas_frames[1:]:
                    frame = frame_to_rhino_plane(compas_frame)
                    frames.append(frame)

            cached_scene_key = create_id(self, "cached_scene")

            if show_cm or show_acm:
                cached_scene = st.get(cached_scene_key)
                if not cached_scene:
                    cached_scene = {"time": 0}

                # expire cache if the component has not been executed in the last 2 seconds
                # this allows to slide through a list of configurations
                # without triggering refreshes of the scene in the middle of it
                if time.time() - cached_scene["time"] > 2:
                    update_scene = True
                else:
                    update_scene = False

                if update_scene:
                    scene = PlanningScene(robot)
                    try:
                        scene = robot.client.get_planning_scene()
                    except BackendFeatureNotSupportedError:
                        print(
                            "The selected backend does not support collision meshes. If you need collision mesh support, use a different backend."
                        )
                        scene = None
                        show_cm = False
                        show_acm = False

                if update_scene and show_cm:
                    collision_meshes = []

                    for co in scene.world.collision_objects:
                        header = co.header
                        frame_id = header.frame_id
                        cms = co.to_collision_meshes()

                        for cm in cms:
                            if cm.frame != Frame.worldXY():
                                t = Transformation.from_frame(cm.frame)
                                mesh = cm.mesh.transformed(t)
                            else:
                                mesh = cm.mesh

                            collision_meshes.extend(SceneObject(mesh).draw())

                        cached_scene["cm"] = collision_meshes

                collision_meshes = cached_scene.get("cm", [])

                if update_scene and show_acm:
                    attached_meshes = []

                    for aco in scene.robot_state.attached_collision_objects:
                        for acm in aco.to_attached_collision_meshes():
                            frame_id = aco.object["header"]["frame_id"]
                            frame = robot.forward_kinematics(configuration, options=dict(link=frame_id))
                            t = Transformation.from_frame(frame)

                            # Local CM frame
                            if acm.collision_mesh.frame and acm.collision_mesh.frame != Frame.worldXY():
                                t = t * Transformation.from_frame(acm.collision_mesh.frame)

                            mesh = acm.collision_mesh.mesh.transformed(t)

                            attached_meshes.extend(SceneObject(mesh).draw())

                    cached_scene["acm"] = attached_meshes

                attached_meshes = cached_scene.get("acm", [])

                cached_scene["time"] = time.time()
                st[cached_scene_key] = cached_scene

        return (
            visual,
            collision,
            collision_meshes,
            attached_meshes,
            frames,
            base_frame,
            ee_frame,
        )
# ---------- end compas_fab_robot_visualize ----------
